# Dynamo graph script0_criar_project_parameters.dyn "script0_set_project_parameters_FIX" (Dynamo 2.1.0.7500)

# group: Parâmetros Type - Categoria Text - Parede
code_block = CodeBlock()
# ---------- code_block.designscript (10 lines) ----------
["ID", "DESCRIPTION", "ENCUNHAMENTO_PARAM",
"ISOLAMENTO_DRYWALL_PARAM", "DEMOLIÇÃO_CERÂMICA_PARAM",
"APICOAMENTO_PARAM", "CHAPISCO_INT_F1_PARAM", "CHAPISCO_INT_F2_PARAM", "CHAPISCO_EXT_PARAM",
"EMBOCO_INT_F1_PARAM", "EMBOCO_INT_F2_PARAM", "EMBOCO_EXT_PARAM", "CERAMICA_INT_F1_PARAM",
"CERAMICA_INT_F2_PARAM", "CERAMICA_EXT_PARAM", "CERAMICA_INT_F1_PARAM", "CERAMICA_INT_F2_PARAM",
"MASSA_UNICA_INT_F1_PARAM", "MASSA_UNICA_INT_F2_PARAM", "MASSA_UNICA_EXT_PARAM",
"SELADOR_INT_F1_PARAM", "SELADOR_INT_F2_PARAM", "SELADOR_EXT_PARAM",
"MASSA_CORRIDA_INT_F1_PARAM", "MASSA_CORRIDA_INT_F2_PARAM", "MASSA_CORRIDA_EXT_PARAM",
"PINTURA_INT_F1_PARAM", "PINTURA_INT_F2_PARAM", "PINTURA_EXT_PARAM",
"TEXTURA_INT_F1_PARAM", "TEXTURA_INT_F2_PARAM", "TEXTURA_EXT_PARAM"];
# ----------------------------------------
code_block_2 = CodeBlock { "Parede"; }
select_parameter_type = ParameterType("Text")
select_builtin_parameter_group = BuiltInParameterGroup("PG_TEXT")
boolean = BoolSelector(false)
categories = Categories("OST_Walls")
createProjectParameter = Parameter.CreateProjectParameter(parameterName=code_block, groupName=code_block_2, type=select_parameter_type, group=select_builtin_parameter_group, instance=boolean, categoryList=categories)

# group: Parâmetros Instance - Categoria Text - Parede
code_block_3 = CodeBlock()
# ---------- code_block_3.designscript (12 lines) ----------
["VÃO", "PAREDE_RVT_COD",
"DIVISORIA_RVT_COD", "CHAPISCO_INT_F1_RVT_COD", "CHAPISCO_INT_F2_RVT_COD",
"CHAPISCO_EXT_RVT_COD", "EMBOCO_INT_F1_RVT_COD", "EMBOCO_INT_F2_RVT_COD",
"EMBOCO_EXT_RVT_COD", "CERAMICA_INT_F1_RVT_COD", "CERAMICA_INT_F2_RVT_COD",
"CERAMICA_EXT_RVT_COD", "MASSA_UNICA_INT_F1_RVT_COD",
"MASSA_UNICA_INT_F2_RVT_COD", "MASSA_UNICA_EXT_RVT_COD",
"SELADOR_INT_F1_RVT_COD", "SELADOR_INT_F2_RVT_COD", "SELADOR_EXT_RVT_COD",
"MASSA_CORRIDA_INT_F1_RVT_COD", "MASSA_CORRIDA_INT_F2_RVT_COD", "MASSA_CORRIDA_EXT_RVT_COD",
"PINTURA_INT_F1_RVT_COD", "PINTURA_INT_F2_RVT_COD", "PINTURA_EXT_RVT_COD",
"TEXTURA_INT_F1_RVT_COD", "TEXTURA_INT_F2_RVT_COD", "TEXTURA_EXT_RVT_COD",
"ENCUNHAMENTO_RVT_COD", "ISOLAMENTO_DRYWALL_RVT_COD",
"DEMOLICAO_CERAMICA_RVT_COD", "APICOAMENTO_RVT_COD"];
# ----------------------------------------
code_block_4 = CodeBlock { "Parede"; }
select_parameter_type_2 = ParameterType("Text")
select_builtin_parameter_group_2 = BuiltInParameterGroup("PG_TEXT")
boolean_2 = BoolSelector(true)
categories_2 = Categories("OST_Walls")
createProjectParameter_2 = Parameter.CreateProjectParameter(parameterName=code_block_3, groupName=code_block_4, type=select_parameter_type_2, group=select_builtin_parameter_group_2, instance=boolean_2, categoryList=categories_2)

# group: Parâmetros Instance - Categoria Data - Parede
code_block_5 = CodeBlock()
# ---------- code_block_5.designscript (12 lines) ----------
["PAREDE_COMP_COD", "DIVISORIA_COMP_COD", "CHAPISCO_INT_F1_COMP_COD",
"CHAPISCO_INT_F2_COMP_COD", "CHAPISCO_EXT_COMP_COD",
"EMBOCO_INT_F1_COMP_COD", "EMBOCO_INT_F2_COMP_COD", "EMBOCO_EXT_COMP_COD",
"CERAMICA_INT_F1_COMP_COD", "CERAMICA_INT_F2_COMP_COD", "CERAMICA_EXT_COMP_COD",
"MASSA_UNICA_INT_F1_COMP_COD", "MASSA_UNICA_INT_F2_COMP_COD", "MASSA_UNICA_EXT_COMP_COD",
"SELADOR_INT_F1_COMP_COD", "SELADOR_INT_F2_COMP_COD", "SELADOR_EXT_COMP_COD",
"MASSA_CORRIDA_INT_F1_COMP_COD", "MASSA_CORRIDA_INT_F2_COMP_COD", "MASSA_CORRIDA_EXT_COMP_COD",
"PINTURA_INT_F1_COMP_COD", "PINTURA_INT_F2_COMP_COD", "PINTURA_EXT_COMP_COD",
"TEXTURA_INT_F1_COMP_COD", "TEXTURA_INT_F2_COMP_COD",
"TEXTURA_EXT_COMP_COD", "ENCUNHAMENTO_COMP_COD",
"ISOLAMENTO_DRYWALL_COMP_COD", "DEMOLICAO_CERAMICA_COMP_COD",
"APICOAMENTO_COMP_COD"];
# ----------------------------------------
code_block_6 = CodeBlock { "Parede"; }
select_parameter_type_3 = ParameterType("Text")
select_builtin_parameter_group_3 = BuiltInParameterGroup("PG_DATA")
boolean_3 = BoolSelector(true)
categories_3 = Categories("OST_Walls")
createProjectParameter_3 = Parameter.CreateProjectParameter(parameterName=code_block_5, groupName=code_block_6, type=select_parameter_type_3, group=select_builtin_parameter_group_3, instance=boolean_3, categoryList=categories_3)

# group: Parâmetros Type - Categoria Text - Porta
code_block_7 = CodeBlock { ["ID", "DESCRIPTION"]; }
code_block_8 = CodeBlock { "Porta"; }
select_parameter_type_4 = ParameterType("Text")
select_builtin_parameter_group_4 = BuiltInParameterGroup("PG_TEXT")
boolean_4 = BoolSelector(false)
categories_4 = Categories("OST_Doors")
createProjectParameter_4 = Parameter.CreateProjectParameter(parameterName=code_block_7, groupName=code_block_8, type=select_parameter_type_4, group=select_builtin_parameter_group_4, instance=boolean_4, categoryList=categories_4)

# group: Parâmetros Instance - Categoria Text - Porta
code_block_9 = CodeBlock { ["ESQUADRIA_RVT_COD", "AREA_ESQUADRIA"]; }
code_block_10 = CodeBlock { "Porta"; }
select_parameter_type_5 = ParameterType("Text")
select_builtin_parameter_group_5 = BuiltInParameterGroup("PG_TEXT")
boolean_5 = BoolSelector(true)
categories_5 = Categories("OST_Doors")
createProjectParameter_5 = Parameter.CreateProjectParameter(parameterName=code_block_9, groupName=code_block_10, type=select_parameter_type_5, group=select_builtin_parameter_group_5, instance=boolean_5, categoryList=categories_5)

# group: Parâmetros Instance - Categoria Data - Porta
code_block_11 = CodeBlock { ["ESQUADRIA_COMP_COD"]; }
code_block_12 = CodeBlock { "Porta"; }
select_parameter_type_6 = ParameterType("Text")
select_builtin_parameter_group_6 = BuiltInParameterGroup("PG_DATA")
boolean_6 = BoolSelector(true)
categories_6 = Categories("OST_Doors")
createProjectParameter_6 = Parameter.CreateProjectParameter(parameterName=code_block_11, groupName=code_block_12, type=select_parameter_type_6, group=select_builtin_parameter_group_6, instance=boolean_6, categoryList=categories_6)

# group: Parâmetros Instance - Categoria Data - Janela
code_block_13 = CodeBlock { ["ESQUADRIA_COMP_COD"]; }
code_block_14 = CodeBlock { "Janela"; }
select_parameter_type_7 = ParameterType("Text")
select_builtin_parameter_group_7 = BuiltInParameterGroup("PG_DATA")
boolean_7 = BoolSelector(true)
categories_7 = Categories("OST_Windows")
createProjectParameter_7 = Parameter.CreateProjectParameter(parameterName=code_block_13, groupName=code_block_14, type=select_parameter_type_7, group=select_builtin_parameter_group_7, instance=boolean_7, categoryList=categories_7)

# group: Parâmetros Instance - Categoria Text - Janela
code_block_15 = CodeBlock { ["ESQUADRIA_RVT_COD", "AREA_ESQUADRIA"]; }
code_block_16 = CodeBlock { "Janela"; }
select_parameter_type_8 = ParameterType("Text")
select_builtin_parameter_group_8 = BuiltInParameterGroup("PG_TEXT")
boolean_8 = BoolSelector(true)
categories_8 = Categories("OST_Windows")
createProjectParameter_8 = Parameter.CreateProjectParameter(parameterName=code_block_15, groupName=code_block_16, type=select_parameter_type_8, group=select_builtin_parameter_group_8, instance=boolean_8, categoryList=categories_8)

# group: Parâmetros Type - Categoria Text - Janela
code_block_17 = CodeBlock { ["ID", "DESCRIPTION"]; }
code_block_18 = CodeBlock { "Janela"; }
select_parameter_type_9 = ParameterType("Text")
select_builtin_parameter_group_9 = BuiltInParameterGroup("PG_TEXT")
boolean_9 = BoolSelector(false)
categories_9 = Categories("OST_Windows")
createProjectParameter_9 = Parameter.CreateProjectParameter(parameterName=code_block_17, groupName=code_block_18, type=select_parameter_type_9, group=select_builtin_parameter_group_9, instance=boolean_9, categoryList=categories_9)
