# Dynamo graph script1_inserir_serviços_vão.dyn "script1_set_parâmetros_serviços_vão_FIX" (Dynamo 2.1.0.7500)

categories = Categories("OST_Windows")
categories_2 = Categories("OST_Doors")

# group: Elementos por categoria
categories_3 = Categories("OST_Walls")
all_elements_of_category = ElementsOfCategory(Category=categories_3)
all_elements_of_category_2 = ElementsOfCategory(Category=categories)
all_elements_of_category_3 = ElementsOfCategory(Category=categories_2)
join = List.Join(list0=all_elements_of_category, list1=all_elements_of_category_2, list2=all_elements_of_category_3)

# group: Elementos por tipos
elementType = Element.ElementType(element=join)
uniqueItems = List.UniqueItems(list=elementType)

# group: Parâmetro "ID" dos elementos
code_block = CodeBlock { "ID"; }
getParameterValueByName = Element.GetParameterValueByName(element=uniqueItems, parameterName=code_block)

nome_da_folha_na_planilha = StringInput("Serviços")  # graph input
boolean = BoolSelector(true)

# group: Importar do Excel
planilha_de_serviços = Filename("..\..\..\Planilha_Treino_mod_nome_parametros.xlsx")  # graph input
file_from_path = FileObject(path=planilha_de_serviços)
boolean_2 = BoolSelector(true)
importExcel = Data.ImportExcel(file=file_from_path, sheetName=nome_da_folha_na_planilha, readAsStrings=boolean_2, showExcel=boolean)

restOfItems = List.RestOfItems(list=importExcel)
code_block_2 = CodeBlock { 1; }
# note: Lista de Serv
getItemAtIndex = List.GetItemAtIndex(list=restOfItems@L2, index=code_block_2)
# note: Pega o valor do ID
firstItem = List.FirstItem(list=getItemAtIndex)
eq = getParameterValueByName == firstItem
# note: In: Elementos que possuem parâmetro ID
filterByBoolMask = List.FilterByBoolMask(list=uniqueItems, mask=eq)
code_block_3 = CodeBlock { 0; }
# note: Lista de param (L2)
getItemAtIndex_2 = List.GetItemAtIndex(list=restOfItems@L2, index=code_block_3)
# note: Lista de param sem ID
restOfItems_2 = List.RestOfItems(list=getItemAtIndex_2)
# note: Lista de Serv sem ID
restOfItems_3 = List.RestOfItems(list=getItemAtIndex)

# group: Transforma L2 para L3
list_create = List.Create(item0=restOfItems_2)
list_create_2 = List.Create(item0=restOfItems_3)

# group: Aqui permite que dois itens de familía diferentes com o mesmo ID recebam os mesmo parâmetros.
count = List.Count(list=filterByBoolMask.in)
ofRepeatedItem = List.OfRepeatedItem(item=list_create, amount=count)
ofRepeatedItem_2 = List.OfRepeatedItem(item=list_create_2, amount=count)

setParameterByName = Element.SetParameterByName(element=filterByBoolMask.in, parameterName=ofRepeatedItem, value=ofRepeatedItem_2)
# note: Primeira linha do excel
firstItem_2 = List.FirstItem(list=importExcel)

# group: Paredes com vão ou sem vão
boolean_3 = BoolSelector(true)
boolean_4 = BoolSelector(false)
inserts = Custom[Element.Inserts](element=all_elements_of_category, includeOpenings=boolean_3, includeShadows=boolean_4, includeEmbeddedWalls=boolean_4, includeSharedEmbeddedInserts=boolean_4)  # Gets all the objects inserted into a given element.
isEmpty = List.IsEmpty(list=inserts@L2)
filterByBoolMask_2 = List.FilterByBoolMask(list=all_elements_of_category, mask=isEmpty)
code_block_4 = CodeBlock { "VÃO"; }
code_block_5 = CodeBlock { "_SEM_VÃO"; }
setParameterByName_2 = Element.SetParameterByName(element=filterByBoolMask_2.in, parameterName=code_block_4, value=code_block_5)
code_block_6 = CodeBlock { "_VÃO"; }
setParameterByName_3 = Element.SetParameterByName(element=filterByBoolMask_2.out, parameterName=code_block_4, value=code_block_6)
