# Dynamo graph script2_classificar_serviços.dyn "script2_set_código_revit_por_serviço_FIX" (Dynamo 2.1.0.7500)

# group: Elementos parede
categories = Categories("OST_Walls")
all_elements_of_category = ElementsOfCategory(Category=categories)
join = List.Join(list0=all_elements_of_category)

elementType = Element.ElementType(element=join)

# group: Planilha com parâmetros Param e Serv
planilha_com_aba = Filename("..\..\Planilha_Treino_mod_nome_parametros.xlsx")  # "Planilha com aba "ParâmetrosXServiços""; graph input
file_from_path = FileObject(path=planilha_com_aba)
aba_parâmetrosxserviço = StringInput("ParâmetrosXServiços")  # graph input
boolean = BoolSelector(true)
importExcel = Data.ImportExcel(file=file_from_path, sheetName=aba_parâmetrosxserviço, readAsStrings=boolean, showExcel=boolean)
restOfItems = List.RestOfItems(list=importExcel)

code_block = CodeBlock { 0; }
getItemAtIndex = List.GetItemAtIndex(list=restOfItems@L2, index=code_block)
# note: Lista de parâmetros
uniqueItems = List.UniqueItems(list=getItemAtIndex)
getParameterValueByName = Element.GetParameterValueByName(element=elementType, parameterName=uniqueItems, lacing=CrossProduct)
string = StringInput("")
ne = getParameterValueByName != string
filterByBoolMask = List.FilterByBoolMask(list=getParameterValueByName, mask=ne)
clean = List.Clean(list=filterByBoolMask.in)

# group: Serviços de alvenaria
python_script = Python(IN[0]=clean, IN[1]=join)
# ---------- python_script.python (33 lines) ----------
# Load the Python Standard and DesignScript Libraries
import sys
import clr
clr.AddReference('ProtoGeometry')
from Autodesk.DesignScript.Geometry import *

# The inputs to this node will be stored as a list in the IN variables.
listOfService = IN[0]
listOfElementsCategory = IN[1]

# Custom variables
listLoop = 0

ALVENARIA_BLC_CERAMICO_9X19X19cm = {"ALVENARIA_BLC_CERAMICO_9X19X19cm": [], "title": []}
ALVENARIA_BLC_CONCETO_9X19X39cm = {"ALVENARIA_BLC_CONCETO_9X19X39cm": [], "title": []}
ALVENARIA_BLC_CONCETO_14X19X39cm = {"ALVENARIA_BLC_CONCETO_14X19X39cm": [], "title": []}

# Place your code below this line
for i in listOfService:
	for j in i:
		if j == "ALVENARIA_BLC_CERAMICO_9X19X19cm":
			ALVENARIA_BLC_CERAMICO_9X19X19cm[j].append(listOfElementsCategory[listLoop])
			ALVENARIA_BLC_CERAMICO_9X19X19cm["title"].insert(0, "ALVENARIA_BLC_CERAMICO_9X19X19cm")
		elif j == "ALVENARIA_BLC_CONCETO_9X19X39cm":
			ALVENARIA_BLC_CONCETO_9X19X39cm[j].append(listOfElementsCategory[listLoop])
			ALVENARIA_BLC_CONCETO_9X19X39cm["title"].insert(0, "ALVENARIA_BLC_CONCETO_9X19X39cm")
		elif j == "ALVENARIA_BLC_CONCETO_14X19X39cm":
			ALVENARIA_BLC_CONCETO_14X19X39cm[j].append(listOfElementsCategory[listLoop])
			ALVENARIA_BLC_CONCETO_14X19X39cm["title"].insert(0, "ALVENARIA_BLC_CONCETO_14X19X39cm")
	listLoop = listLoop + 1

# Assign your output to the OUT variable.
OUT = ALVENARIA_BLC_CERAMICO_9X19X19cm["title"] + ALVENARIA_BLC_CONCETO_9X19X39cm["title"] + ALVENARIA_BLC_CONCETO_14X19X39cm["title"], ALVENARIA_BLC_CERAMICO_9X19X19cm["ALVENARIA_BLC_CERAMICO_9X19X19cm"], ALVENARIA_BLC_CONCETO_9X19X39cm["ALVENARIA_BLC_CONCETO_9X19X39cm"], ALVENARIA_BLC_CONCETO_14X19X39cm["ALVENARIA_BLC_CONCETO_14X19X39cm"]
# ----------------------------------------
# note: Elementos (paredes)
restOfItems_2 = List.RestOfItems(list=python_script@L3)
# note: Limpa listas vazias
clean_2 = List.Clean(list=restOfItems_2@L1)
code_block_2 = CodeBlock { "Area"; }
# note: Pega valor das Áreas
getParameterValueByName_2 = Element.GetParameterValueByName(element=clean_2@L1, parameterName=code_block_2)
code_block_3 = CodeBlock { 6; }
lt = getParameterValueByName_2 < code_block_3
# note: Filtra paredes < 6m² das > 6m²
filterByBoolMask_2 = List.FilterByBoolMask(list=clean_2, mask=lt)
flatten = List.Flatten(list=filterByBoolMask_2.out)
list_create = List.Create(item0=flatten)
# note: RVT_COD
python_script_2 = Python(IN[0]=clean)
# ---------- python_script_2.python (20 lines) ----------
# Load the Python Standard and DesignScript Libraries
import sys
import clr
clr.AddReference('ProtoGeometry')
from Autodesk.DesignScript.Geometry import *

# The inputs to this node will be stored as a list in the IN variables.
listOfService = IN[0]

# Custom variables
PAREDE_RVT_COD = []

# Place your code below this line
for i in listOfService:
	for j in i:
		if j == "ALVENARIA_BLC_CERAMICO_9X19X19cm" or j == "ALVENARIA_BLC_CONCETO_9X19X39cm" or j == "ALVENARIA_BLC_CONCETO_14X19X39cm":
			PAREDE_RVT_COD.append("PAREDE_RVT_COD")

# Assign your output to the OUT variable.
OUT = PAREDE_RVT_COD
# ----------------------------------------
# note: Adiciona 1 nível (L3)
list_create_2 = List.Create(item0=python_script_2)
# note: Separa rvt_code por paredes < 6m² e > 6m²
filterByBoolMask_3 = List.FilterByBoolMask(list=list_create_2@L2, mask=lt)
# note: Valor dos parâmetros de serviço
firstItem = List.FirstItem(list=python_script@L3)
# note: Filtra serviços de paredes < 6m² das > 6m²
filterByBoolMask_4 = List.FilterByBoolMask(list=firstItem@L2, mask=lt)
code_block_4 = CodeBlock { "VÃO"; }
# note: Valor do parâmetro VÃO
getParameterValueByName_3 = Element.GetParameterValueByName(element=clean_2@L1, parameterName=code_block_4)
# note: Filtra paredes < 6m² das > 6m² com e sem vãos
filterByBoolMask_5 = List.FilterByBoolMask(list=getParameterValueByName_3, mask=lt)
list_create_3 = List.Create(item0=filterByBoolMask_5.out)
code_block_5 = CodeBlock { "_>=6m2"; }
code_block_6 = CodeBlock(x=filterByBoolMask_4.out, y=list_create_3, z=code_block_5) { x + y + z; }
setParameterByName = Element.SetParameterByName(element=list_create, parameterName=filterByBoolMask_3.out, value=code_block_6)
flatten_2 = List.Flatten(list=filterByBoolMask_2.in)
list_create_4 = List.Create(item0=flatten_2)
list_create_5 = List.Create(item0=filterByBoolMask_5.in)
code_block_7 = CodeBlock { "_<6m2"; }
code_block_8 = CodeBlock(x=filterByBoolMask_4.in, y=list_create_5, z=code_block_7) { x + y + z; }
setParameterByName_2 = Element.SetParameterByName(element=list_create_4, parameterName=filterByBoolMask_3.in, value=code_block_8)

# group: Serviços com classificação apenas de "com vão" e "sem vão"
python_script_3 = Python(IN[0]=clean, IN[1]=join)
# ---------- python_script_3.python (98 lines) ----------
# Load the Python Standard and DesignScript Libraries
import sys
import clr
clr.AddReference('ProtoGeometry')
from Autodesk.DesignScript.Geometry import *

# The inputs to this node will be stored as a list in the IN variables.
listOfService = IN[0]
listOfElementsCategory = IN[1]

# Custom variables
listLoop = 0

DRYWALL_SIMPLES = {"DRYWALL_SIMPLES": [], "title": []}
DRYWALL_DUPLA = {"DRYWALL_DUPLA": [], "title": []}
CHAPISCO_EXT_SERV = {"CHAPISCO_EXT_SERV": [], "title": []}
EMBOCO_EXT_SERV_25mm = {"EMBOCO_EXT_SERV_25mm": [], "title": []}
EMBOCO_EXT_SERV_35mm = {"EMBOCO_EXT_SERV_35mm": [], "title": []}
EMBOCO_EXT_SERV_45mm = {"EMBOCO_EXT_SERV_45mm": [], "title": []}
EMBOCO_EXT_SERV_50mm = {"EMBOCO_EXT_SERV_50mm": [], "title": []}
MASSA_UNICA_EXT_SERV_25mm = {"MASSA_UNICA_EXT_SERV_25mm": [], "title": []}
MASSA_UNICA_EXT_SERV_35mm = {"MASSA_UNICA_EXT_SERV_35mm": [], "title": []}
MASSA_UNICA_EXT_SERV_45mm = {"MASSA_UNICA_EXT_SERV_45mm": [], "title": []}
MASSA_UNICA_EXT_SERV_50mm = {"MASSA_UNICA_EXT_SERV_50mm": [], "title": []}
CERAMICA_PORCELANA_EXT_5X5cm = {"CERAMICA_PORCELANA_EXT_5X5cm": [], "title": []}
CERAMICA_PORCELANA_EXT_5X10cm = {"CERAMICA_PORCELANA_EXT_5X10cm": [], "title": []}
MASSA_CORRIDA_ACRILICA_EXT_UMA_DEMAO_MULTPAV_SERV = {"MASSA_CORRIDA_ACRILICA_EXT_UMA_DEMAO_MULTPAV_SERV": [], "title": []}
MASSA_CORRIDA_ACRILICA_EXT_DUAS_DEMAOS_MULTPAV_SERV = {"MASSA_CORRIDA_ACRILICA_EXT_DUAS_DEMAOS_MULTPAV_SERV": [], "title": []}
SELADOR_ACRILICO_EXT_MULTPAV_SERV = {"SELADOR_ACRILICO_EXT_MULTPAV_SERV": [], "title": []}
PINTURA_ACRILICA_EXT_MULTPAV_SERV = {"PINTURA_ACRILICA_EXT_MULTPAV_SERV": [], "title": []}
TEXTURA_ACRILICA_EXT_UMA_COR_MULTPAV_SERV = {"TEXTURA_ACRILICA_EXT_UMA_COR_MULTPAV_SERV": [], "title": []}
TEXTURA_ACRILICA_EXT_DUAS_CORES_MULTPAV_SERV = {"TEXTURA_ACRILICA_EXT_DUAS_CORES_MULTPAV_SERV": [], "title": []}

# Place your code below this line
for i in listOfService:
	for j in i:
		if j == "DRYWALL_SIMPLES":
			DRYWALL_SIMPLES[j].append(listOfElementsCategory[listLoop])
			DRYWALL_SIMPLES["title"].insert(0, "DRYWALL_SIMPLES")
		elif j == "DRYWALL_DUPLA":
			DRYWALL_DUPLA[j].append(listOfElementsCategory[listLoop])
			DRYWALL_DUPLA["title"].insert(0, "DRYWALL_DUPLA")
		elif j == "CHAPISCO_EXT_SERV":
			CHAPISCO_EXT_SERV[j].append(listOfElementsCategory[listLoop])
			CHAPISCO_EXT_SERV["title"].insert(0, "CHAPISCO_EXT_SERV")
		elif j == "EMBOCO_EXT_SERV_25mm":
			EMBOCO_EXT_SERV_25mm[j].append(listOfElementsCategory[listLoop])
			EMBOCO_EXT_SERV_25mm["title"].insert(0, "EMBOCO_EXT_SERV_25mm")
		elif j == "EMBOCO_EXT_SERV_35mm":
			EMBOCO_EXT_SERV_35mm[j].append(listOfElementsCategory[listLoop])
			EMBOCO_EXT_SERV_35mm["title"].insert(0, "EMBOCO_EXT_SERV_35mm")
		elif j == "EMBOCO_EXT_SERV_45mm":
			EMBOCO_EXT_SERV_45mm[j].append(listOfElementsCategory[listLoop])
			EMBOCO_EXT_SERV_45mm["title"].insert(0, "EMBOCO_EXT_SERV_45mm")
		elif j == "EMBOCO_EXT_SERV_50mm":
			EMBOCO_EXT_SERV_50mm[j].append(listOfElementsCategory[listLoop])
			EMBOCO_EXT_SERV_50mm["title"].insert(0, "EMBOCO_EXT_SERV_50mm")
		elif j == "MASSA_UNICA_EXT_SERV_25mm":
			MASSA_UNICA_EXT_SERV_25mm[j].append(listOfElementsCategory[listLoop])
			MASSA_UNICA_EXT_SERV_25mm["title"].insert(0, "MASSA_UNICA_EXT_SERV_25mm")	
		elif j == "MASSA_UNICA_EXT_SERV_35mm":
			MASSA_UNICA_EXT_SERV_35mm[j].append(listOfElementsCategory[listLoop])
			MASSA_UNICA_EXT_SERV_35mm["title"].insert(0, "MASSA_UNICA_EXT_SERV_35mm")	
		elif j == "MASSA_UNICA_EXT_SERV_45mm":
			MASSA_UNICA_EXT_SERV_45mm[j].append(listOfElementsCategory[listLoop])
			MASSA_UNICA_EXT_SERV_45mm["title"].insert(0, "MASSA_UNICA_EXT_SERV_45mm")	
		elif j == "MASSA_UNICA_EXT_SERV_50mm":
			MASSA_UNICA_EXT_SERV_50mm[j].append(listOfElementsCategory[listLoop])
			MASSA_UNICA_EXT_SERV_50mm["title"].insert(0, "MASSA_UNICA_EXT_SERV_50mm")	
		elif j == "CERAMICA_PORCELANA_EXT_5X5cm":
			CERAMICA_PORCELANA_EXT_5X5cm[j].append(listOfElementsCategory[listLoop])
			CERAMICA_PORCELANA_EXT_5X5cm["title"].insert(0, "CERAMICA_PORCELANA_EXT_5X5cm")	
		elif j == "CERAMICA_PORCELANA_EXT_5X10cm":
			CERAMICA_PORCELANA_EXT_5X10cm[j].append(listOfElementsCategory[listLoop])
			CERAMICA_PORCELANA_EXT_5X10cm["title"].insert(0, "CERAMICA_PORCELANA_EXT_5X10cm")	
		elif j == "MASSA_CORRIDA_ACRILICA_EXT_UMA_DEMAO_MULTPAV_SERV":
			MASSA_CORRIDA_ACRILICA_EXT_UMA_DEMAO_MULTPAV_SERV[j].append(listOfElementsCategory[listLoop])
			MASSA_CORRIDA_ACRILICA_EXT_UMA_DEMAO_MULTPAV_SERV["title"].insert(0, "MASSA_CORRIDA_ACRILICA_EXT_UMA_DEMAO_MULTPAV_SERV")	
		elif j == "MASSA_CORRIDA_ACRILICA_EXT_DUAS_DEMAOS_MULTPAV_SERV":
			MASSA_CORRIDA_ACRILICA_EXT_DUAS_DEMAOS_MULTPAV_SERV[j].append(listOfElementsCategory[listLoop])
			MASSA_CORRIDA_ACRILICA_EXT_DUAS_DEMAOS_MULTPAV_SERV["title"].insert(0, "MASSA_CORRIDA_ACRILICA_EXT_DUAS_DEMAOS_MULTPAV_SERV")
		elif j == "SELADOR_ACRILICO_EXT_MULTPAV_SERV":
			SELADOR_ACRILICO_EXT_MULTPAV_SERV[j].append(listOfElementsCategory[listLoop])
			SELADOR_ACRILICO_EXT_MULTPAV_SERV["title"].insert(0, "SELADOR_ACRILICO_EXT_MULTPAV_SERV")
		elif j == "PINTURA_ACRILICA_EXT_MULTPAV_SERV":
			PINTURA_ACRILICA_EXT_MULTPAV_SERV[j].append(listOfElementsCategory[listLoop])
			PINTURA_ACRILICA_EXT_MULTPAV_SERV["title"].insert(0, "PINTURA_ACRILICA_EXT_MULTPAV_SERV")
		elif j == "TEXTURA_ACRILICA_EXT_UMA_COR_MULTPAV_SERV":
			TEXTURA_ACRILICA_EXT_UMA_COR_MULTPAV_SERV[j].append(listOfElementsCategory[listLoop])
			TEXTURA_ACRILICA_EXT_UMA_COR_MULTPAV_SERV["title"].insert(0, "TEXTURA_ACRILICA_EXT_UMA_COR_MULTPAV_SERV")
		elif j == "TEXTURA_ACRILICA_EXT_DUAS_CORES_MULTPAV_SERV":
			TEXTURA_ACRILICA_EXT_DUAS_CORES_MULTPAV_SERV[j].append(listOfElementsCategory[listLoop])
			TEXTURA_ACRILICA_EXT_DUAS_CORES_MULTPAV_SERV["title"].insert(0, "TEXTURA_ACRILICA_EXT_DUAS_CORES_MULTPAV_SERV")

	listLoop = listLoop + 1

# Assign your output to the OUT variable.
OUT = DRYWALL_SIMPLES["title"] + DRYWALL_DUPLA["title"] + CHAPISCO_EXT_SERV["title"] + EMBOCO_EXT_SERV_25mm["title"] + EMBOCO_EXT_SERV_35mm["title"] + EMBOCO_EXT_SERV_45mm["title"] + EMBOCO_EXT_SERV_50mm["title"] + MASSA_UNICA_EXT_SERV_25mm["title"] + MASSA_UNICA_EXT_SERV_35mm["title"] + MASSA_UNICA_EXT_SERV_45mm["title"] + MASSA_UNICA_EXT_SERV_50mm["title"] + CERAMICA_PORCELANA_EXT_5X5cm["title"] + CERAMICA_PORCELANA_EXT_5X10cm["title"] + MASSA_CORRIDA_ACRILICA_EXT_UMA_DEMAO_MULTPAV_SERV["title"] + MASSA_CORRIDA_ACRILICA_EXT_DUAS_DEMAOS_MULTPAV_SERV["title"] + SELADOR_ACRILICO_EXT_MULTPAV_SERV["title"] + PINTURA_ACRILICA_EXT_MULTPAV_SERV["title"] + TEXTURA_ACRILICA_EXT_UMA_COR_MULTPAV_SERV["title"] + TEXTURA_ACRILICA_EXT_DUAS_CORES_MULTPAV_SERV["title"], DRYWALL_SIMPLES["DRYWALL_SIMPLES"], DRYWALL_DUPLA["DRYWALL_DUPLA"], CHAPISCO_EXT_SERV["CHAPISCO_EXT_SERV"], EMBOCO_EXT_SERV_25mm["EMBOCO_EXT_SERV_25mm"], EMBOCO_EXT_SERV_35mm["EMBOCO_EXT_SERV_35mm"], EMBOCO_EXT_SERV_45mm["EMBOCO_EXT_SERV_45mm"], EMBOCO_EXT_SERV_50mm["EMBOCO_EXT_SERV_50mm"], MASSA_UNICA_EXT_SERV_25mm["MASSA_UNICA_EXT_SERV_25mm"], MASSA_UNICA_EXT_SERV_35mm["MASSA_UNICA_EXT_SERV_35mm"], MASSA_UNICA_EXT_SERV_45mm["MASSA_UNICA_EXT_SERV_45mm"], MASSA_UNICA_EXT_SERV_50mm["MASSA_UNICA_EXT_SERV_50mm"], CERAMICA_PORCELANA_EXT_5X5cm["CERAMICA_PORCELANA_EXT_5X5cm"], CERAMICA_PORCELANA_EXT_5X10cm["CERAMICA_PORCELANA_EXT_5X10cm"], MASSA_CORRIDA_ACRILICA_EXT_UMA_DEMAO_MULTPAV_SERV["MASSA_CORRIDA_ACRILICA_EXT_UMA_DEMAO_MULTPAV_SERV"], MASSA_CORRIDA_ACRILICA_EXT_DUAS_DEMAOS_MULTPAV_SERV["MASSA_CORRIDA_ACRILICA_EXT_DUAS_DEMAOS_MULTPAV_SERV"], SELADOR_ACRILICO_EXT_MULTPAV_SERV["SELADOR_ACRILICO_EXT_MULTPAV_SERV"], PINTURA_ACRILICA_EXT_MULTPAV_SERV["PINTURA_ACRILICA_EXT_MULTPAV_SERV"], TEXTURA_ACRILICA_EXT_UMA_COR_MULTPAV_SERV["TEXTURA_ACRILICA_EXT_UMA_COR_MULTPAV_SERV"], TEXTURA_ACRILICA_EXT_DUAS_CORES_MULTPAV_SERV["TEXTURA_ACRILICA_EXT_DUAS_CORES_MULTPAV_SERV"]
# ----------------------------------------
# note: Elementos (paredes)
restOfItems_3 = List.RestOfItems(list=python_script_3@L3)
# note: Limpa listas vazias
clean_3 = List.Clean(list=restOfItems_3@L1)
# note: RVT_COD
python_script_4 = Python(IN[0]=clean)
# ---------- python_script_4.python (42 lines) ----------
# Load the Python Standard and DesignScript Libraries
import sys
import clr
clr.AddReference('ProtoGeometry')
from Autodesk.DesignScript.Geometry import *

# The inputs to this node will be stored as a list in the IN variables.
listOfService = IN[0]

# Custom variables
PAREDE_RVT_COD = []
CHAPISCO_EXT_RVT_COD = []
EMBOCO_EXT_RVT_COD = []
MASSA_UNICA_EXT_RVT_COD = []
CERAMICA_EXT_RVT_COD = []
MASSA_CORRIDA_EXT_RVT_COD = []
SELADOR_EXT_RVT_COD = []
PINTURA_EXT_RVT_COD = []
TEXTURA_EXT_RVT_COD = []
# Place your code below this line
for i in listOfService:
	for j in i:
		if j == "DRYWALL_SIMPLES" or j == "DRYWALL_DUPLA":
			PAREDE_RVT_COD.append("PAREDE_RVT_COD")
		elif j == "CHAPISCO_EXT_SERV":
			CHAPISCO_EXT_RVT_COD.append("CHAPISCO_EXT_RVT_COD")
		elif j == "EMBOCO_EXT_SERV_25mm" or j == "EMBOCO_EXT_SERV_35mm" or j == "EMBOCO_EXT_SERV_45mm" or j == "EMBOCO_EXT_SERV_50mm":
			EMBOCO_EXT_RVT_COD.append("EMBOCO_EXT_RVT_COD")
		elif j == "MASSA_UNICA_EXT_SERV_25mm" or j == "MASSA_UNICA_EXT_SERV_35mm" or j == "MASSA_UNICA_EXT_SERV_45mm" or j == "MASSA_UNICA_EXT_SERV_50mm":
			MASSA_UNICA_EXT_RVT_COD.append("MASSA_UNICA_EXT_RVT_COD")
		elif j == "CERAMICA_PORCELANA_EXT_5X5cm" or j == "CERAMICA_PORCELANA_EXT_5X10cm":
			CERAMICA_EXT_RVT_COD.append("CERAMICA_EXT_RVT_COD")
		elif j == "MASSA_CORRIDA_ACRILICA_EXT_UMA_DEMAO_MULTPAV_SERV" or j == "MASSA_CORRIDA_ACRILICA_EXT_DUAS_DEMAOS_MULTPAV_SERV":
			MASSA_CORRIDA_EXT_RVT_COD.append("MASSA_CORRIDA_EXT_RVT_COD")
		elif j == "SELADOR_ACRILICO_EXT_MULTPAV_SERV":
			SELADOR_EXT_RVT_COD.append("SELADOR_EXT_RVT_COD")
		elif j == "PINTURA_ACRILICA_EXT_MULTPAV_SERV":
			PINTURA_EXT_RVT_COD.append("PINTURA_EXT_RVT_COD")
		elif j == "TEXTURA_ACRILICA_EXT_UMA_COR_MULTPAV_SERV" or j == "TEXTURA_ACRILICA_EXT_DUAS_CORES_MULTPAV_SERV":
			TEXTURA_EXT_RVT_COD.append("TEXTURA_EXT_RVT_COD")
# Assign your output to the OUT variable.
OUT = PAREDE_RVT_COD + CHAPISCO_EXT_RVT_COD + EMBOCO_EXT_RVT_COD + MASSA_UNICA_EXT_RVT_COD + CERAMICA_EXT_RVT_COD + MASSA_CORRIDA_EXT_RVT_COD + SELADOR_EXT_RVT_COD + PINTURA_EXT_RVT_COD + TEXTURA_EXT_RVT_COD
# ----------------------------------------
# note: Adiciona um nível (L3)
list_create_6 = List.Create(item0=python_script_4)
# note: Valor dos parâmetros de serviço
firstItem_2 = List.FirstItem(list=python_script_3@L3)
code_block_9 = CodeBlock { "VÃO"; }
# note: Valor do parâmetro VÃO
getParameterValueByName_4 = Element.GetParameterValueByName(element=clean_3@L1, parameterName=code_block_9)
# note: Concatena nomes
code_block_10 = CodeBlock(x=firstItem_2, y=getParameterValueByName_4) { x[0] + y; }

# note: Coloca elementos no mesmo nível
flatten_3 = List.Flatten(list=clean_3)
# note: Adiciona 1 nível (L3)
list_create_7 = List.Create(item0=flatten_3)
# note: Adicionado 1 nível (L3)
list_create_8 = List.Create(item0=code_block_10)

# group (continued): Serviços com classificação apenas de "com vão" e "sem vão"
# note: Coloca valor do parâmetro nas paredes
setParameterByName_3 = Element.SetParameterByName(element=list_create_7, parameterName=list_create_6, value=list_create_8)

# group: Elementos que não dependem de classificação além do seu parâmetro Serv
# note: Modificado
python_script_5 = Python(IN[0]=clean, IN[1]=join)
# ---------- python_script_5.python (181 lines) ----------
# Load the Python Standard and DesignScript Libraries
import sys
import clr
clr.AddReference('ProtoGeometry')
from Autodesk.DesignScript.Geometry import *

# The inputs to this node will be stored as a list in the IN variables.
listOfService = IN[0]
listOfElementsCategory = IN[1]

# Custom variables
listLoop = 0

PAREDE_BLC_GESSO_10cm = {"PAREDE_BLC_GESSO_10cm": [], "title": []}
CHAPISCO_INT_F1_SERV = {"CHAPISCO_INT_F1_SERV": [], "title": []}
CHAPISCO_INT_F2_SERV = {"CHAPISCO_INT_F2_SERV": [], "title": []}
DIVISORIA_EUCATEX_PAINEL = {"DIVISORIA_EUCATEX_PAINEL": [], "title": []}
DIVISORIA_EUCATEX_PAINEL_VIDRO = {"DIVISORIA_EUCATEX_PAINEL_VIDRO": [], "title": []}
DIVISORIA_EUCATEX_PAINEL_VIDRO_PAINEL = {"DIVISORIA_EUCATEX_PAINEL_VIDRO_PAINEL": [], "title": []}
DIVISORIA_PISO_TETO_PAINEL = {"DIVISORIA_PISO_TETO_PAINEL": [], "title": []}
DIVISORIA_PISO_TETO_VIDRO = {"DIVISORIA_PISO_TETO_VIDRO": [], "title": []}
DIVISORIA_PVC_PAINEL = {"DIVISORIA_PVC_PAINEL": [], "title": []}
DIVISORIA_PVC_PAINEL_VIDRO = {"DIVISORIA_PVC_PAINEL_VIDRO": [], "title": []}
DIVISORIA_PVC_PAINEL_VIDRO_PAINEL = {"DIVISORIA_PVC_PAINEL_VIDRO_PAINEL": [], "title": []}
DIVISORIA_GRANITO = {"DIVISORIA_GRANITO": [], "title": []}
SELADOR_ACRILICO_INT_F1_SERV = {"SELADOR_ACRILICO_INT_F1_SERV": [], "title": []}
SELADOR_ACRILICO_INT_F2_SERV = {"SELADOR_ACRILICO_INT_F2_SERV": [], "title": []}
SELADOR_PVA_INT_F1_SERV = {"SELADOR_PVA_INT_F1_SERV": [], "title": []}
SELADOR_PVA_INT_F2_SERV = {"SELADOR_PVA_INT_F2_SERV": [], "title": []}
SELADOR_ACRILICO_EXT_TERREO_SERV = {"SELADOR_ACRILICO_EXT_TERREO_SERV": [], "title": []}
MASSA_UNICA_INT_F1_SERV_10mm = {"MASSA_UNICA_INT_F1_SERV_10mm": [], "title": []}
MASSA_UNICA_INT_F2_SERV_10mm = {"MASSA_UNICA_INT_F2_SERV_10mm": [], "title": []}
MASSA_UNICA_INT_F1_SERV_20mm = {"MASSA_UNICA_INT_F1_SERV_20mm": [], "title": []}
MASSA_UNICA_INT_F2_SERV_20mm = {"MASSA_UNICA_INT_F2_SERV_20mm": [], "title": []}
MASSA_CORRIDA_LATEX_INT_F1_UMA_DEMAO_SERV = {"MASSA_CORRIDA_LATEX_INT_F1_UMA_DEMAO_SERV": [], "title": []}
MASSA_CORRIDA_LATEX_INT_F2_UMA_DEMAO_SERV = {"MASSA_CORRIDA_LATEX_INT_F2_UMA_DEMAO_SERV": [], "title": []}
MASSA_CORRIDA_LATEX_INT_F1_DUAS_DEMAOS_SERV = {"MASSA_CORRIDA_LATEX_INT_F1_DUAS_DEMAOS_SERV": [], "title": []}
MASSA_CORRIDA_LATEX_INT_F2_DUAS_DEMAOS_SERV = {"MASSA_CORRIDA_LATEX_INT_F2_DUAS_DEMAOS_SERV": [], "title": []}
MASSA_CORRIDA_ACRILICA_EXT_UMA_DEMAO_TERREO_SERV = {"MASSA_CORRIDA_ACRILICA_EXT_UMA_DEMAO_TERREO_SERV": [], "title": []}
MASSA_CORRIDA_ACRILICA_EXT_DUAS_DEMAOS_TERREO_SERV = {"MASSA_CORRIDA_ACRILICA_EXT_DUAS_DEMAOS_TERREO_SERV": [], "title": []}
PINTURA_PVA_INT_F1_SERV = {"PINTURA_PVA_INT_F1_SERV": [], "title": []}
PINTURA_PVA_INT_F2_SERV = {"PINTURA_PVA_INT_F2_SERV": [], "title": []}
PINTURA_ACRILICA_INT_F1_SERV = {"PINTURA_ACRILICA_INT_F1_SERV": [], "title": []}
PINTURA_ACRILICA_INT_F2_SERV = {"PINTURA_ACRILICA_INT_F2_SERV": [], "title": []}
PINTURA_ACRILICA_EXT_TERREO_SERV = {"PINTURA_ACRILICA_EXT_TERREO_SERV": [], "title": []}
TEXTURA_ACRILICA_INT_F1_SERV = {"TEXTURA_ACRILICA_INT_F1_SERV": [], "title": []}
TEXTURA_ACRILICA_INT_F2_SERV = {"TEXTURA_ACRILICA_INT_F2_SERV": [], "title": []}
TEXTURA_ACRILICA_EXT_UMA_COR_TERREO_SERV = {"TEXTURA_ACRILICA_EXT_UMA_COR_TERREO_SERV": [], "title": []}
TEXTURA_ACRILICA_EXT_DUAS_CORES_TERREO_SERV = {"TEXTURA_ACRILICA_EXT_DUAS_CORES_TERREO_SERV": [], "title": []}
ENCUNHAMENTO_SERV = {"ENCUNHAMENTO_SERV": [], "title": []}
ISOLAMENTO_DRYWALL_SERV = {"ISOLAMENTO_DRYWALL_SERV": [], "title": []}
DEMOLIÇÃO_CERÂMICA_SERV = {"DEMOLIÇÃO_CERÂMICA_SERV": [], "title": []}
APICOAMENTO_SERV = {"APICOAMENTO_SERV": [], "title": []}

# Place your code below this line
for i in listOfService:
	for j in i:
		if j == "PAREDE_BLC_GESSO_10cm":
			PAREDE_BLC_GESSO_10cm[j].append(listOfElementsCategory[listLoop])
			PAREDE_BLC_GESSO_10cm["title"].insert(0, "PAREDE_BLC_GESSO_10cm")
		elif j == "CHAPISCO_INT_F1_SERV":
			CHAPISCO_INT_F1_SERV[j].append(listOfElementsCategory[listLoop])
			CHAPISCO_INT_F1_SERV["title"].insert(0, "CHAPISCO_INT_F1_SERV")
		elif j == "CHAPISCO_INT_F2_SERV":
			CHAPISCO_INT_F2_SERV[j].append(listOfElementsCategory[listLoop])
			CHAPISCO_INT_F2_SERV["title"].insert(0, "CHAPISCO_INT_F2_SERV")
		elif j == "DIVISORIA_EUCATEX_PAINEL":
			DIVISORIA_EUCATEX_PAINEL[j].append(listOfElementsCategory[listLoop])
			DIVISORIA_EUCATEX_PAINEL["title"].insert(0, "DIVISORIA_EUCATEX_PAINEL")
		elif j == "DIVISORIA_EUCATEX_PAINEL_VIDRO":
			DIVISORIA_EUCATEX_PAINEL_VIDRO[j].append(listOfElementsCategory[listLoop])
			DIVISORIA_EUCATEX_PAINEL_VIDRO["title"].insert(0, "DIVISORIA_EUCATEX_PAINEL_VIDRO")
		elif j == "DIVISORIA_EUCATEX_PAINEL_VIDRO_PAINEL":
			DIVISORIA_EUCATEX_PAINEL_VIDRO_PAINEL[j].append(listOfElementsCategory[listLoop])
			DIVISORIA_EUCATEX_PAINEL_VIDRO_PAINEL["title"].insert(0, "DIVISORIA_EUCATEX_PAINEL_VIDRO_PAINEL")
		elif j == "DIVISORIA_PISO_TETO_PAINEL":
			DIVISORIA_PISO_TETO_PAINEL[j].append(listOfElementsCategory[listLoop])
			DIVISORIA_PISO_TETO_PAINEL["title"].insert(0, "DIVISORIA_PISO_TETO_PAINEL")
		elif j == "DIVISORIA_PISO_TETO_VIDRO":
			DIVISORIA_PISO_TETO_VIDRO[j].append(listOfElementsCategory[listLoop])
			DIVISORIA_PISO_TETO_VIDRO["title"].insert(0, "DIVISORIA_PISO_TETO_VIDRO")
		elif j == "DIVISORIA_PVC_PAINEL":
			DIVISORIA_PVC_PAINEL[j].append(listOfElementsCategory[listLoop])
			DIVISORIA_PVC_PAINEL["title"].insert(0, "DIVISORIA_PVC_PAINEL")
		elif j == "DIVISORIA_PVC_PAINEL_VIDRO":
			DIVISORIA_PVC_PAINEL_VIDRO[j].append(listOfElementsCategory[listLoop])
			DIVISORIA_PVC_PAINEL_VIDRO["title"].insert(0, "DIVISORIA_PVC_PAINEL_VIDRO")
		elif j == "DIVISORIA_PVC_PAINEL_VIDRO_PAINEL":
			DIVISORIA_PVC_PAINEL_VIDRO_PAINEL[j].append(listOfElementsCategory[listLoop])
			DIVISORIA_PVC_PAINEL_VIDRO_PAINEL["title"].insert(0, "DIVISORIA_PVC_PAINEL_VIDRO_PAINEL")
		elif j == "DIVISORIA_GRANITO":
			DIVISORIA_GRANITO[j].append(listOfElementsCategory[listLoop])
			DIVISORIA_GRANITO["title"].insert(0, "DIVISORIA_GRANITO")
		elif j == "SELADOR_ACRILICO_INT_F1_SERV":
			SELADOR_ACRILICO_INT_F1_SERV[j].append(listOfElementsCategory[listLoop])
			SELADOR_ACRILICO_INT_F1_SERV["title"].insert(0, "SELADOR_ACRILICO_INT_F1_SERV")
		elif j == "SELADOR_ACRILICO_INT_F2_SERV":
			SELADOR_ACRILICO_INT_F2_SERV[j].append(listOfElementsCategory[listLoop])
			SELADOR_ACRILICO_INT_F2_SERV["title"].insert(0, "SELADOR_ACRILICO_INT_F2_SERV")
		elif j == "SELADOR_PVA_INT_F1_SERV":
			SELADOR_PVA_INT_F1_SERV[j].append(listOfElementsCategory[listLoop])
			SELADOR_PVA_INT_F1_SERV["title"].insert(0, "SELADOR_PVA_INT_F1_SERV")
		elif j == "SELADOR_PVA_INT_F2_SERV":
			SELADOR_PVA_INT_F2_SERV[j].append(listOfElementsCategory[listLoop])
			SELADOR_PVA_INT_F2_SERV["title"].insert(0, "SELADOR_PVA_INT_F2_SERV")
		elif j == "SELADOR_ACRILICO_EXT_TERREO_SERV":
			SELADOR_ACRILICO_EXT_TERREO_SERV[j].append(listOfElementsCategory[listLoop])
			SELADOR_ACRILICO_EXT_TERREO_SERV["title"].insert(0, "SELADOR_ACRILICO_EXT_TERREO_SERV")
		elif j == "MASSA_UNICA_INT_F1_SERV_10mm":
			MASSA_UNICA_INT_F1_SERV_10mm[j].append(listOfElementsCategory[listLoop])
			MASSA_UNICA_INT_F1_SERV_10mm["title"].insert(0, "MASSA_UNICA_INT_F1_SERV_10mm")
		elif j == "MASSA_UNICA_INT_F2_SERV_10mm":
			MASSA_UNICA_INT_F2_SERV_10mm[j].append(listOfElementsCategory[listLoop])
			MASSA_UNICA_INT_F2_SERV_10mm["title"].insert(0, "MASSA_UNICA_INT_F2_SERV_10mm")
		elif j == "MASSA_UNICA_INT_F1_SERV_20mm":
			MASSA_UNICA_INT_F1_SERV_20mm[j].append(listOfElementsCategory[listLoop])
			MASSA_UNICA_INT_F1_SERV_20mm["title"].insert(0, "MASSA_UNICA_INT_F1_SERV_20mm")
		elif j == "MASSA_UNICA_INT_F2_SERV_20mm":
			MASSA_UNICA_INT_F2_SERV_20mm[j].append(listOfElementsCategory[listLoop])
			MASSA_UNICA_INT_F2_SERV_20mm["title"].insert(0, "MASSA_UNICA_INT_F2_SERV_20mm")
		elif j == "MASSA_CORRIDA_LATEX_INT_F1_UMA_DEMAO_SERV":
			MASSA_CORRIDA_LATEX_INT_F1_UMA_DEMAO_SERV[j].append(listOfElementsCategory[listLoop])
			MASSA_CORRIDA_LATEX_INT_F1_UMA_DEMAO_SERV["title"].insert(0, "MASSA_CORRIDA_LATEX_INT_F1_UMA_DEMAO_SERV")
		elif j == "MASSA_CORRIDA_LATEX_INT_F2_UMA_DEMAO_SERV":
			MASSA_CORRIDA_LATEX_INT_F2_UMA_DEMAO_SERV[j].append(listOfElementsCategory[listLoop])
			MASSA_CORRIDA_LATEX_INT_F2_UMA_DEMAO_SERV["title"].insert(0, "MASSA_CORRIDA_LATEX_INT_F2_UMA_DEMAO_SERV")
		elif j == "MASSA_CORRIDA_LATEX_INT_F1_DUAS_DEMAOS_SERV":
			MASSA_CORRIDA_LATEX_INT_F1_DUAS_DEMAOS_SERV[j].append(listOfElementsCategory[listLoop])
			MASSA_CORRIDA_LATEX_INT_F1_DUAS_DEMAOS_SERV["title"].insert(0, "MASSA_CORRIDA_LATEX_INT_F1_DUAS_DEMAOS_SERV")
		elif j == "MASSA_CORRIDA_LATEX_INT_F2_DUAS_DEMAOS_SERV":
			MASSA_CORRIDA_LATEX_INT_F2_DUAS_DEMAOS_SERV[j].append(listOfElementsCategory[listLoop])
			MASSA_CORRIDA_LATEX_INT_F2_DUAS_DEMAOS_SERV["title"].insert(0, "MASSA_CORRIDA_LATEX_INT_F2_DUAS_DEMAOS_SERV")
		elif j == "MASSA_CORRIDA_ACRILICA_EXT_UMA_DEMAO_TERREO_SERV":
			MASSA_CORRIDA_ACRILICA_EXT_UMA_DEMAO_TERREO_SERV[j].append(listOfElementsCategory[listLoop])
			MASSA_CORRIDA_ACRILICA_EXT_UMA_DEMAO_TERREO_SERV["title"].insert(0, "MASSA_CORRIDA_ACRILICA_EXT_UMA_DEMAO_TERREO_SERV")
		elif j == "MASSA_CORRIDA_ACRILICA_EXT_DUAS_DEMAOS_TERREO_SERV":
			MASSA_CORRIDA_ACRILICA_EXT_DUAS_DEMAOS_TERREO_SERV[j].append(listOfElementsCategory[listLoop])
			MASSA_CORRIDA_ACRILICA_EXT_DUAS_DEMAOS_TERREO_SERV["title"].insert(0, "MASSA_CORRIDA_ACRILICA_EXT_DUAS_DEMAOS_TERREO_SERV")
		elif j == "PINTURA_PVA_INT_F1_SERV":
			PINTURA_PVA_INT_F1_SERV[j].append(listOfElementsCategory[listLoop])
			PINTURA_PVA_INT_F1_SERV["title"].insert(0, "PINTURA_PVA_INT_F1_SERV")
		elif j == "PINTURA_PVA_INT_F2_SERV":
			PINTURA_PVA_INT_F2_SERV[j].append(listOfElementsCategory[listLoop])
			PINTURA_PVA_INT_F2_SERV["title"].insert(0, "PINTURA_PVA_INT_F2_SERV")
		elif j == "PINTURA_ACRILICA_INT_F1_SERV":
			PINTURA_ACRILICA_INT_F1_SERV[j].append(listOfElementsCategory[listLoop])
			PINTURA_ACRILICA_INT_F1_SERV["title"].insert(0, "PINTURA_ACRILICA_INT_F1_SERV")
		elif j == "PINTURA_ACRILICA_INT_F2_SERV":
			PINTURA_ACRILICA_INT_F2_SERV[j].append(listOfElementsCategory[listLoop])
			PINTURA_ACRILICA_INT_F2_SERV["title"].insert(0, "PINTURA_ACRILICA_INT_F2_SERV")
		elif j == "PINTURA_ACRILICA_EXT_TERREO_SERV":
			PINTURA_ACRILICA_EXT_TERREO_SERV[j].append(listOfElementsCategory[listLoop])
			PINTURA_ACRILICA_EXT_TERREO_SERV["title"].insert(0, "PINTURA_ACRILICA_EXT_TERREO_SERV")
		elif j == "TEXTURA_ACRILICA_INT_F1_SERV":
			TEXTURA_ACRILICA_INT_F1_SERV[j].append(listOfElementsCategory[listLoop])
			TEXTURA_ACRILICA_INT_F1_SERV["title"].insert(0, "TEXTURA_ACRILICA_INT_F1_SERV")
		elif j == "TEXTURA_ACRILICA_INT_F2_SERV":
			TEXTURA_ACRILICA_INT_F2_SERV[j].append(listOfElementsCategory[listLoop])
			TEXTURA_ACRILICA_INT_F2_SERV["title"].insert(0, "TEXTURA_ACRILICA_INT_F2_SERV")
		elif j == "TEXTURA_ACRILICA_EXT_UMA_COR_TERREO_SERV":
			TEXTURA_ACRILICA_EXT_UMA_COR_TERREO_SERV[j].append(listOfElementsCategory[listLoop])
			TEXTURA_ACRILICA_EXT_UMA_COR_TERREO_SERV["title"].insert(0, "TEXTURA_ACRILICA_EXT_UMA_COR_TERREO_SERV")
		elif j == "TEXTURA_ACRILICA_EXT_DUAS_CORES_TERREO_SERV":
			TEXTURA_ACRILICA_EXT_DUAS_CORES_TERREO_SERV[j].append(listOfElementsCategory[listLoop])
			TEXTURA_ACRILICA_EXT_DUAS_CORES_TERREO_SERV["title"].insert(0, "TEXTURA_ACRILICA_EXT_DUAS_CORES_TERREO_SERV")
		elif j == "ENCUNHAMENTO_SERV":
			ENCUNHAMENTO_SERV[j].append(listOfElementsCategory[listLoop])
			ENCUNHAMENTO_SERV["title"].insert(0, "ENCUNHAMENTO_SERV")
		elif j == "ISOLAMENTO_DRYWALL_SERV":
			ISOLAMENTO_DRYWALL_SERV[j].append(listOfElementsCategory[listLoop])
			ISOLAMENTO_DRYWALL_SERV["title"].insert(0, "ISOLAMENTO_DRYWALL_SERV")
		elif j == "DEMOLIÇÃO_CERÂMICA_SERV":
			DEMOLIÇÃO_CERÂMICA_SERV[j].append(listOfElementsCategory[listLoop])
			DEMOLIÇÃO_CERÂMICA_SERV["title"].insert(0, "DEMOLIÇÃO_CERÂMICA_SERV")
		elif j == "APICOAMENTO_SERV":
			APICOAMENTO_SERV[j].append(listOfElementsCategory[listLoop])
			APICOAMENTO_SERV["title"].insert(0, "APICOAMENTO_SERV")	
	listLoop = listLoop + 1

# Assign your output to the OUT variable.
OUT = PAREDE_BLC_GESSO_10cm["title"] + CHAPISCO_INT_F1_SERV["title"] + CHAPISCO_INT_F2_SERV["title"] + DIVISORIA_EUCATEX_PAINEL["title"] + DIVISORIA_EUCATEX_PAINEL_VIDRO["title"] + DIVISORIA_EUCATEX_PAINEL_VIDRO_PAINEL["title"] + DIVISORIA_PISO_TETO_PAINEL["title"] + DIVISORIA_PISO_TETO_VIDRO["title"] + DIVISORIA_PVC_PAINEL["title"] + DIVISORIA_PVC_PAINEL_VIDRO["title"] + DIVISORIA_PVC_PAINEL_VIDRO_PAINEL["title"] + DIVISORIA_GRANITO["title"] + SELADOR_ACRILICO_INT_F1_SERV["title"] + SELADOR_ACRILICO_INT_F2_SERV["title"] + SELADOR_PVA_INT_F1_SERV["title"] + SELADOR_PVA_INT_F2_SERV["title"] + SELADOR_ACRILICO_EXT_TERREO_SERV["title"] + MASSA_UNICA_INT_F1_SERV_10mm["title"] + MASSA_UNICA_INT_F2_SERV_10mm["title"] + MASSA_UNICA_INT_F1_SERV_20mm["title"] + MASSA_UNICA_INT_F2_SERV_20mm["title"] + MASSA_CORRIDA_LATEX_INT_F1_UMA_DEMAO_SERV["title"] + MASSA_CORRIDA_LATEX_INT_F2_UMA_DEMAO_SERV["title"] + MASSA_CORRIDA_LATEX_INT_F1_DUAS_DEMAOS_SERV["title"] + MASSA_CORRIDA_LATEX_INT_F2_DUAS_DEMAOS_SERV["title"] + MASSA_CORRIDA_ACRILICA_EXT_UMA_DEMAO_TERREO_SERV["title"] + MASSA_CORRIDA_ACRILICA_EXT_DUAS_DEMAOS_TERREO_SERV["title"] + PINTURA_PVA_INT_F1_SERV["title"] + PINTURA_PVA_INT_F2_SERV["title"] + PINTURA_ACRILICA_INT_F1_SERV["title"] + PINTURA_ACRILICA_INT_F2_SERV["title"] + PINTURA_ACRILICA_EXT_TERREO_SERV["title"] + TEXTURA_ACRILICA_INT_F1_SERV["title"] + TEXTURA_ACRILICA_INT_F2_SERV["title"] + TEXTURA_ACRILICA_EXT_UMA_COR_TERREO_SERV["title"] + TEXTURA_ACRILICA_EXT_DUAS_CORES_TERREO_SERV["title"] + ENCUNHAMENTO_SERV["title"] + ISOLAMENTO_DRYWALL_SERV["title"] + DEMOLIÇÃO_CERÂMICA_SERV["title"] + APICOAMENTO_SERV["title"], PAREDE_BLC_GESSO_10cm["PAREDE_BLC_GESSO_10cm"], CHAPISCO_INT_F1_SERV["CHAPISCO_INT_F1_SERV"], CHAPISCO_INT_F2_SERV["CHAPISCO_INT_F2_SERV"], DIVISORIA_EUCATEX_PAINEL["DIVISORIA_EUCATEX_PAINEL"], DIVISORIA_EUCATEX_PAINEL_VIDRO["DIVISORIA_EUCATEX_PAINEL_VIDRO"], DIVISORIA_EUCATEX_PAINEL_VIDRO_PAINEL["DIVISORIA_EUCATEX_PAINEL_VIDRO_PAINEL"], DIVISORIA_PISO_TETO_PAINEL["DIVISORIA_PISO_TETO_PAINEL"], DIVISORIA_PISO_TETO_VIDRO["DIVISORIA_PISO_TETO_VIDRO"], DIVISORIA_PVC_PAINEL["DIVISORIA_PVC_PAINEL"], DIVISORIA_PVC_PAINEL_VIDRO["DIVISORIA_PVC_PAINEL_VIDRO"], DIVISORIA_PVC_PAINEL_VIDRO_PAINEL["DIVISORIA_PVC_PAINEL_VIDRO_PAINEL"], DIVISORIA_GRANITO["DIVISORIA_GRANITO"], SELADOR_ACRILICO_INT_F1_SERV["SELADOR_ACRILICO_INT_F1_SERV"], SELADOR_ACRILICO_INT_F2_SERV["SELADOR_ACRILICO_INT_F2_SERV"], SELADOR_PVA_INT_F1_SERV["SELADOR_PVA_INT_F1_SERV"], SELADOR_PVA_INT_F2_SERV["SELADOR_PVA_INT_F2_SERV"], SELADOR_ACRILICO_EXT_TERREO_SERV["SELADOR_ACRILICO_EXT_TERREO_SERV"], MASSA_UNICA_INT_F1_SERV_10mm["MASSA_UNICA_INT_F1_SERV_10mm"], MASSA_UNICA_INT_F2_SERV_10mm["MASSA_UNICA_INT_F2_SERV_10mm"], MASSA_UNICA_INT_F1_SERV_20mm["MASSA_UNICA_INT_F1_SERV_20mm"], MASSA_UNICA_INT_F2_SERV_20mm["MASSA_UNICA_INT_F2_SERV_20mm"], MASSA_CORRIDA_LATEX_INT_F1_UMA_DEMAO_SERV["MASSA_CORRIDA_LATEX_INT_F1_UMA_DEMAO_SERV"], MASSA_CORRIDA_LATEX_INT_F2_UMA_DEMAO_SERV["MASSA_CORRIDA_LATEX_INT_F2_UMA_DEMAO_SERV"], MASSA_CORRIDA_LATEX_INT_F1_DUAS_DEMAOS_SERV["MASSA_CORRIDA_LATEX_INT_F1_DUAS_DEMAOS_SERV"], MASSA_CORRIDA_LATEX_INT_F2_DUAS_DEMAOS_SERV["MASSA_CORRIDA_LATEX_INT_F2_DUAS_DEMAOS_SERV"], MASSA_CORRIDA_ACRILICA_EXT_UMA_DEMAO_TERREO_SERV["MASSA_CORRIDA_ACRILICA_EXT_UMA_DEMAO_TERREO_SERV"], MASSA_CORRIDA_ACRILICA_EXT_DUAS_DEMAOS_TERREO_SERV["MASSA_CORRIDA_ACRILICA_EXT_DUAS_DEMAOS_TERREO_SERV"], PINTURA_PVA_INT_F1_SERV["PINTURA_PVA_INT_F1_SERV"], PINTURA_PVA_INT_F2_SERV["PINTURA_PVA_INT_F2_SERV"], PINTURA_ACRILICA_INT_F1_SERV["PINTURA_ACRILICA_INT_F1_SERV"], PINTURA_ACRILICA_INT_F2_SERV["PINTURA_ACRILICA_INT_F2_SERV"], PINTURA_ACRILICA_EXT_TERREO_SERV["PINTURA_ACRILICA_EXT_TERREO_SERV"], TEXTURA_ACRILICA_INT_F1_SERV["TEXTURA_ACRILICA_INT_F1_SERV"], TEXTURA_ACRILICA_INT_F2_SERV["TEXTURA_ACRILICA_INT_F2_SERV"], TEXTURA_ACRILICA_EXT_UMA_COR_TERREO_SERV["TEXTURA_ACRILICA_EXT_UMA_COR_TERREO_SERV"], TEXTURA_ACRILICA_EXT_DUAS_CORES_TERREO_SERV["TEXTURA_ACRILICA_EXT_DUAS_CORES_TERREO_SERV"], ENCUNHAMENTO_SERV["ENCUNHAMENTO_SERV"], ISOLAMENTO_DRYWALL_SERV["ISOLAMENTO_DRYWALL_SERV"], DEMOLIÇÃO_CERÂMICA_SERV["DEMOLIÇÃO_CERÂMICA_SERV"], APICOAMENTO_SERV["APICOAMENTO_SERV"]
# ----------------------------------------
# note: Elementos (paredes)
restOfItems_4 = List.RestOfItems(list=python_script_5@L3)
# note: Limpa listas vazias
clean_4 = List.Clean(list=restOfItems_4@L1)
# note: RVT_COD
python_script_6 = Python(IN[0]=clean)
# ---------- python_script_6.python (82 lines) ----------
# Load the Python Standard and DesignScript Libraries
import sys
import clr
clr.AddReference('ProtoGeometry')
from Autodesk.DesignScript.Geometry import *

# The inputs to this node will be stored as a list in the IN variables.
listOfService = IN[0]

# Custom variables
PAREDE_RVT_COD = []
CHAPISCO_INT_F1_RVT_COD = []
CHAPISCO_INT_F2_RVT_COD = []
DIVISORIA_RVT_COD = []
SELADOR_INT_F1_RVT_COD = []
SELADOR_INT_F2_RVT_COD = []
SELADOR_EXT_RVT_COD = []
MASSA_UNICA_INT_F1_RVT_COD = []
MASSA_UNICA_INT_F2_RVT_COD = []
MASSA_CORRIDA_INT_F1_RVT_COD = []
MASSA_CORRIDA_INT_F2_RVT_COD = []
MASSA_CORRIDA_EXT_RVT_COD = []
PINTURA_INT_F1_RVT_COD = []
PINTURA_INT_F2_RVT_COD = [] 
PINTURA_EXT_RVT_COD = []
TEXTURA_INT_F1_RVT_COD = []
TEXTURA_INT_F2_RVT_COD = []
TEXTURA_EXT_RVT_COD = []
ENCUNHAMENTO_RVT_COD = []
ISOLAMENTO_DRYWALL_RVT_COD = []
DEMOLICAO_CERAMICA_RVT_COD = []
APICOAMENTO_RVT_COD = []

# Place your code below this line
for i in listOfService:
	for j in i:
		if j == "PAREDE_BLC_GESSO_10cm":
			PAREDE_RVT_COD.append("PAREDE_RVT_COD")
		elif j == "CHAPISCO_INT_F1_SERV":
			CHAPISCO_INT_F1_RVT_COD.append("CHAPISCO_INT_F1_RVT_COD")
		elif j == "CHAPISCO_INT_F2_SERV":
			CHAPISCO_INT_F2_RVT_COD.append("CHAPISCO_INT_F2_RVT_COD")
		elif j == "DIVISORIA_EUCATEX_PAINEL" or j == "DIVISORIA_EUCATEX_PAINEL_VIDRO" or j == "DIVISORIA_EUCATEX_PAINEL_VIDRO_PAINEL" or j == "DIVISORIA_PISO_TETO_PAINEL" or j == "DIVISORIA_PISO_TETO_VIDRO" or j == "DIVISORIA_PVC_PAINEL" or j == "DIVISORIA_PVC_PAINEL_VIDRO" or j == "DIVISORIA_PVC_PAINEL_VIDRO_PAINEL" or j == "DIVISORIA_GRANITO":
			DIVISORIA_RVT_COD.append("DIVISORIA_RVT_COD")
		elif j == "SELADOR_ACRILICO_INT_F1_SERV" or j == "SELADOR_PVA_INT_F1_SERV":
			SELADOR_INT_F1_RVT_COD.append("SELADOR_INT_F1_RVT_COD")
		elif j == "SELADOR_ACRILICO_INT_F2_SERV" or j == "SELADOR_PVA_INT_F2_SERV":
			SELADOR_INT_F2_RVT_COD.append("SELADOR_INT_F2_RVT_COD")
		elif j == "SELADOR_ACRILICO_EXT_TERREO_SERV":
			SELADOR_EXT_RVT_COD.append("SELADOR_EXT_RVT_COD")
		elif j == "MASSA_UNICA_INT_F1_SERV_10mm" or j == "MASSA_UNICA_INT_F1_SERV_20mm":
			MASSA_UNICA_INT_F1_RVT_COD.append("MASSA_UNICA_INT_F1_RVT_COD")
		elif j == "MASSA_UNICA_INT_F2_SERV_10mm" or j == "MASSA_UNICA_INT_F2_SERV_20mm":
			MASSA_UNICA_INT_F2_RVT_COD.append("MASSA_UNICA_INT_F2_RVT_COD")
		elif j == "MASSA_CORRIDA_LATEX_INT_F1_UMA_DEMAO_SERV" or j == "MASSA_CORRIDA_LATEX_INT_F1_DUAS_DEMAOS_SERV":
			MASSA_CORRIDA_INT_F1_RVT_COD.append("MASSA_CORRIDA_INT_F1_RVT_COD")
		elif j == "MASSA_CORRIDA_LATEX_INT_F2_UMA_DEMAO_SERV" or j == "MASSA_CORRIDA_LATEX_INT_F2_DUAS_DEMAOS_SERV":
			MASSA_CORRIDA_INT_F2_RVT_COD.append("MASSA_CORRIDA_INT_F2_RVT_COD")
		elif j == "MASSA_CORRIDA_ACRILICA_EXT_UMA_DEMAO_TERREO_SERV" or j == "MASSA_CORRIDA_ACRILICA_EXT_DUAS_DEMAOS_TERREO_SERV":
			MASSA_CORRIDA_EXT_RVT_COD.append("MASSA_CORRIDA_EXT_RVT_COD")
		elif j == "PINTURA_PVA_INT_F1_SERV" or j == "PINTURA_ACRILICA_INT_F1_SERV":
			PINTURA_INT_F1_RVT_COD.append("PINTURA_INT_F1_RVT_COD")
		elif j == "PINTURA_PVA_INT_F2_SERV" or j == "PINTURA_ACRILICA_INT_F2_SERV":
			PINTURA_INT_F2_RVT_COD.append("PINTURA_INT_F2_RVT_COD")
		elif j == "PINTURA_ACRILICA_EXT_TERREO_SERV":
			PINTURA_EXT_RVT_COD.append("PINTURA_EXT_RVT_COD")
		elif j == "TEXTURA_ACRILICA_INT_F1_SERV":
			TEXTURA_INT_F1_RVT_COD.append("TEXTURA_INT_F1_RVT_COD")
		elif j == "TEXTURA_ACRILICA_INT_F2_SERV":
			TEXTURA_INT_F2_RVT_COD.append("TEXTURA_INT_F2_RVT_COD")
		elif j == "TEXTURA_ACRILICA_EXT_UMA_COR_TERREO_SERV" or j == "TEXTURA_ACRILICA_EXT_DUAS_CORES_TERREO_SERV":
			TEXTURA_EXT_RVT_COD.append("TEXTURA_EXT_RVT_COD")
		elif j == "ENCUNHAMENTO_SERV":
			ENCUNHAMENTO_RVT_COD.append("ENCUNHAMENTO_RVT_COD")
		elif j == "ISOLAMENTO_DRYWALL_SERV":
			ISOLAMENTO_DRYWALL_RVT_COD.append("ISOLAMENTO_DRYWALL_RVT_COD")
		elif j == "DEMOLIÇÃO_CERÂMICA_SERV":
			DEMOLICAO_CERAMICA_RVT_COD.append("DEMOLICAO_CERAMICA_RVT_COD")
		elif j == "APICOAMENTO_SERV":
			APICOAMENTO_RVT_COD.append("APICOAMENTO_RVT_COD")
# Assign your output to the OUT variable.
OUT = PAREDE_RVT_COD + CHAPISCO_INT_F1_RVT_COD + CHAPISCO_INT_F2_RVT_COD + DIVISORIA_RVT_COD + SELADOR_INT_F1_RVT_COD + SELADOR_INT_F2_RVT_COD + SELADOR_EXT_RVT_COD + MASSA_UNICA_INT_F1_RVT_COD + MASSA_UNICA_INT_F2_RVT_COD + MASSA_CORRIDA_INT_F1_RVT_COD + MASSA_CORRIDA_INT_F2_RVT_COD + MASSA_CORRIDA_EXT_RVT_COD + PINTURA_INT_F1_RVT_COD + PINTURA_INT_F2_RVT_COD +  PINTURA_EXT_RVT_COD + TEXTURA_INT_F1_RVT_COD + TEXTURA_INT_F2_RVT_COD + TEXTURA_EXT_RVT_COD + ENCUNHAMENTO_RVT_COD + ISOLAMENTO_DRYWALL_RVT_COD + DEMOLICAO_CERAMICA_RVT_COD + APICOAMENTO_RVT_COD
# ----------------------------------------
# note: Adiciona um nível (L3)
list_create_9 = List.Create(item0=python_script_6)
# note: Valor dos parâmetros de serviço
firstItem_3 = List.FirstItem(list=python_script_5@L3)
# note: Concatena nomes
code_block_11 = CodeBlock(x=firstItem_3) { x[0]; }

flatten_4 = List.Flatten(list=clean_4)
list_create_10 = List.Create(item0=flatten_4)
list_create_11 = List.Create(item0=code_block_11)

# group (continued): Elementos que não dependem de classificação além do seu parâmetro Serv
# note: Coloca valor do parâmetro nas paredes
setParameterByName_4 = Element.SetParameterByName(element=list_create_10, parameterName=list_create_9, value=list_create_11)

# group: Elementos com área< 5m², área >= 5m², área <=10m² e área > 10m² - Emboço Interno e Ceramicas Internas
# note: Modificado
python_script_7 = Python(IN[0]=clean, IN[1]=join)
# ---------- python_script_7.python (26 lines) ----------
# Load the Python Standard and DesignScript Libraries
import sys
import clr
clr.AddReference('ProtoGeometry')
from Autodesk.DesignScript.Geometry import *

# The inputs to this node will be stored as a list in the IN variables.
listOfService = IN[0]
listOfElementsCategory = IN[1]

# Custom variables
listLoop = 0

output = {"element": [], "rvt_serv": []}


# Place your code below this line
for i in listOfService:
	for j in i:
		if j == 'EMBOCO_INT_F1_SERV_10mm' or j == 'EMBOCO_INT_F2_SERV_10mm' or j == 'EMBOCO_INT_F1_SERV_20mm' or j == 'EMBOCO_INT_F2_SERV_20mm' or j == 'CERAMICA_INT_F1_SERV_33x45cm' or j == 'CERAMICA_INT_F2_SERV_33x45cm' or j == 'CERAMICA_INT_F1_MEIA_PAREDE_SERV_33x45cm' or j == 'CERAMICA_INT_F2_MEIA_PAREDE_SERV_33x45cm' or j == 'CERAMICA_INT_F1_SERV_30x60cm' or j == 'CERAMICA_INT_F2_SERV_30x60cm' or j == 'CERAMICA_INT_F1_MEIA_PAREDE_SERV_30x60cm' or j == 'CERAMICA_INT_F2_MEIA_PAREDE_SERV_30x60cm' or j == 'CERAMICA_PORCELANATO_INT_F1_SERV_30x60cm' or j == 'CERAMICA_PORCELANATO_INT_F2_SERV_30x60cm' or j == 'CERAMICA_PORCELANATO_INT_F1_MEIA_PAREDE_SERV_30x60cm' or j == 'CERAMICA_PORCELANATO_INT_F2_MEIA_PAREDE_SERV_30x60cm' or j == 'CERAMICA_PORCELANA_INT_F1_SERV_5x10cm' or j == 'CERAMICA_PORCELANA_INT_F2_SERV_5x10cm' or j == 'CERAMICA_PORCELANA_INT_F1_MEIA_PAREDE_SERV_5x10cm' or j == 'CERAMICA_PORCELANA_INT_F2_MEIA_PAREDE_SERV_5x10cm':
			output["element"].append(listOfElementsCategory[listLoop])
			output["rvt_serv"].append(j)
	listLoop = listLoop + 1

# Assign your output to the OUT variable.
OUT = output["rvt_serv"], output["element"]
# ----------------------------------------
# note: Elementos (paredes)
restOfItems_5 = List.RestOfItems(list=python_script_7@L3)
# note: Limpa listas vazias
clean_5 = List.Clean(list=restOfItems_5@L1)
code_block_12 = CodeBlock { "Area"; }
# note: Valor dos parâmetros de serviço
firstItem_4 = List.FirstItem(list=python_script_7@L3)
# note: RVT_COD
python_script_8 = Python(IN[0]=clean)
# ---------- python_script_8.python (26 lines) ----------
# Load the Python Standard and DesignScript Libraries
import sys
import clr
clr.AddReference('ProtoGeometry')
from Autodesk.DesignScript.Geometry import *

# The inputs to this node will be stored as a list in the IN variables.
listOfService = IN[0]

# Custom variables
RVT_COD = []

# Place your code below this line
for i in listOfService:
	for j in i:
		if j == 'EMBOCO_INT_F1_SERV_10mm' or j == 'EMBOCO_INT_F1_SERV_20mm':
			RVT_COD.append("EMBOCO_INT_F1_RVT_COD")
		elif j == 'CERAMICA_INT_F1_SERV_33x45cm' or j == 'CERAMICA_INT_F1_MEIA_PAREDE_SERV_33x45cm' or j == 'CERAMICA_INT_F1_SERV_30x60cm' or j == 'CERAMICA_INT_F1_MEIA_PAREDE_SERV_30x60cm' or j == 'CERAMICA_PORCELANATO_INT_F1_SERV_30x60cm' or j == 'CERAMICA_PORCELANATO_INT_F1_MEIA_PAREDE_SERV_30x60cm' or j == 'CERAMICA_PORCELANA_INT_F1_SERV_5x10cm' or j == 'CERAMICA_PORCELANA_INT_F1_MEIA_PAREDE_SERV_5x10cm':
			RVT_COD.append("CERAMICA_INT_F1_RVT_COD")
		elif j == 'EMBOCO_INT_F2_SERV_10mm' or j == 'EMBOCO_INT_F2_SERV_20mm':
			RVT_COD.append("EMBOCO_INT_F2_RVT_COD")
		elif j == 'CERAMICA_INT_F2_SERV_33x45cm' or j == 'CERAMICA_INT_F2_MEIA_PAREDE_SERV_33x45cm' or j == 'CERAMICA_INT_F2_SERV_30x60cm' or j == 'CERAMICA_INT_F2_MEIA_PAREDE_SERV_30x60cm' or j == 'CERAMICA_PORCELANATO_INT_F2_SERV_30x60cm' or j == 'CERAMICA_PORCELANATO_INT_F2_MEIA_PAREDE_SERV_30x60cm' or j == 'CERAMICA_PORCELANA_INT_F2_SERV_5x10cm' or j == 'CERAMICA_PORCELANA_INT_F2_MEIA_PAREDE_SERV_5x10cm':
			RVT_COD.append("CERAMICA_INT_F1_RVT_COD")

# Assign your output to the OUT variable.
OUT = RVT_COD
# ----------------------------------------

# note: Passar de L3 para L2
flatten_5 = List.Flatten(list=clean_5)

# group (continued): Elementos com área< 5m², área >= 5m², área <=10m² e área > 10m² - Emboço Interno e Ceramicas Internas
# note: Pega valor das Áreas
getParameterValueByName_5 = Element.GetParameterValueByName(element=flatten_5, parameterName=code_block_12)

# note: Modificado
python_script_9 = Python(IN[0]=flatten_5, IN[1]=getParameterValueByName_5, IN[2]=firstItem_4, IN[3]=python_script_8)
# ---------- python_script_9.python (44 lines) ----------
# Load the Python Standard and DesignScript Libraries
import sys
import clr
clr.AddReference('ProtoGeometry')
from Autodesk.DesignScript.Geometry import *

# The inputs to this node will be stored as a list in the IN variables.
wallElements = IN[0]  ##  L2 -len igual a areaValue
areaValues = IN[1] ## L2 - len igual a wallElements
servParams = IN[2]   # L3
rvtCod =  IN[3] # escolher o L2

walls = []
paramsValue = []
outRvtCod = []

# Place your code below this line
for i in range(len(areaValues)):
  if areaValues[i] < 5:
    if servParams[0][i] == 'EMBOCO_INT_F1_SERV_10mm' or servParams[0][i] == 'EMBOCO_INT_F2_SERV_10mm' or servParams[0][i] == 'EMBOCO_INT_F1_SERV_20mm' or servParams[0][i] == 'EMBOCO_INT_F2_SERV_20mm' or servParams[0][i] == 'CERAMICA_INT_F1_SERV_33x45cm' or servParams[0][i] == 'CERAMICA_INT_F2_SERV_33x45cm' or servParams[0][i] == 'CERAMICA_INT_F1_MEIA_PAREDE_SERV_33x45cm' or servParams[0][i] == 'CERAMICA_INT_F2_MEIA_PAREDE_SERV_33x45cm' or servParams[0][i] == 'CERAMICA_INT_F1_SERV_30x60cm' or servParams[0][i] == 'CERAMICA_INT_F2_SERV_30x60cm' or servParams[0][i] == 'CERAMICA_INT_F1_MEIA_PAREDE_SERV_30x60cm' or servParams[0][i] == 'CERAMICA_INT_F2_MEIA_PAREDE_SERV_30x60cm' or servParams[0][i] == 'CERAMICA_PORCELANATO_INT_F1_SERV_30x60cm' or servParams[0][i] == 'CERAMICA_PORCELANATO_INT_F2_SERV_30x60cm' or servParams[0][i] == 'CERAMICA_PORCELANATO_INT_F1_MEIA_PAREDE_SERV_30x60cm' or servParams[0][i] == 'CERAMICA_PORCELANATO_INT_F2_MEIA_PAREDE_SERV_30x60cm' or servParams[0][i] == 'CERAMICA_PORCELANA_INT_F1_SERV_5x10cm' or servParams[0][i] == 'CERAMICA_PORCELANA_INT_F2_SERV_5x10cm' or servParams[0][i] == 'CERAMICA_PORCELANA_INT_F1_MEIA_PAREDE_SERV_5x10cm' or servParams[0][i] == 'CERAMICA_PORCELANA_INT_F2_MEIA_PAREDE_SERV_5x10cm':
      walls.append(wallElements[i])
      paramsValue.append(servParams[0][i]+'_<5m2')
      outRvtCod.append(rvtCod[i])
  elif areaValues[i] >= 5 and areaValues[i] <= 10:
    if servParams[0][i] == 'EMBOCO_INT_F1_SERV_10mm' or servParams[0][i] == 'EMBOCO_INT_F2_SERV_10mm' or servParams[0][i] == 'EMBOCO_INT_F1_SERV_20mm' or servParams[0][i] == 'EMBOCO_INT_F2_SERV_20mm':
      walls.append(wallElements[i])
      paramsValue.append(servParams[0][i]+'_>=5m2_E_<=10m2')
      outRvtCod.append(rvtCod[i])
    elif servParams[0][i] == 'CERAMICA_INT_F1_SERV_33x45cm' or servParams[0][i] == 'CERAMICA_INT_F2_SERV_33x45cm' or servParams[0][i] == 'CERAMICA_INT_F1_MEIA_PAREDE_SERV_33x45cm' or servParams[0][i] == 'CERAMICA_INT_F2_MEIA_PAREDE_SERV_33x45cm' or servParams[0][i] == 'CERAMICA_INT_F1_SERV_30x60cm' or servParams[0][i] == 'CERAMICA_INT_F2_SERV_30x60cm' or servParams[0][i] == 'CERAMICA_INT_F1_MEIA_PAREDE_SERV_30x60cm' or servParams[0][i] == 'CERAMICA_INT_F2_MEIA_PAREDE_SERV_30x60cm' or servParams[0][i] == 'CERAMICA_PORCELANATO_INT_F1_SERV_30x60cm' or servParams[0][i] == 'CERAMICA_PORCELANATO_INT_F2_SERV_30x60cm' or servParams[0][i] == 'CERAMICA_PORCELANATO_INT_F1_MEIA_PAREDE_SERV_30x60cm' or servParams[0][i] == 'CERAMICA_PORCELANATO_INT_F2_MEIA_PAREDE_SERV_30x60cm' or servParams[0][i] == 'CERAMICA_PORCELANA_INT_F1_SERV_5x10cm' or servParams[0][i] == 'CERAMICA_PORCELANA_INT_F2_SERV_5x10cm' or servParams[0][i] == 'CERAMICA_PORCELANA_INT_F1_MEIA_PAREDE_SERV_5x10cm' or servParams[0][i] == 'CERAMICA_PORCELANA_INT_F2_MEIA_PAREDE_SERV_5x10cm':
      walls.append(wallElements[i])
      paramsValue.append(servParams[0][i]+'_>=5m2')
      outRvtCod.append(rvtCod[i])
  elif areaValues[i] > 10:
    if servParams[0][i] == 'EMBOCO_INT_F1_SERV_10mm' or servParams[0][i] == 'EMBOCO_INT_F2_SERV_10mm' or servParams[0][i] == 'EMBOCO_INT_F1_SERV_20mm' or servParams[0][i] == 'EMBOCO_INT_F2_SERV_20mm':
      walls.append(wallElements[i])
      paramsValue.append(servParams[0][i]+'_>10m2')
      outRvtCod.append(rvtCod[i])
    elif servParams[0][i] == 'CERAMICA_INT_F1_SERV_33x45cm' or servParams[0][i] == 'CERAMICA_INT_F2_SERV_33x45cm' or servParams[0][i] == 'CERAMICA_INT_F1_MEIA_PAREDE_SERV_33x45cm' or servParams[0][i] == 'CERAMICA_INT_F2_MEIA_PAREDE_SERV_33x45cm' or servParams[0][i] == 'CERAMICA_INT_F1_SERV_30x60cm' or servParams[0][i] == 'CERAMICA_INT_F2_SERV_30x60cm' or servParams[0][i] == 'CERAMICA_INT_F1_MEIA_PAREDE_SERV_30x60cm' or servParams[0][i] == 'CERAMICA_INT_F2_MEIA_PAREDE_SERV_30x60cm' or servParams[0][i] == 'CERAMICA_PORCELANATO_INT_F1_SERV_30x60cm' or servParams[0][i] == 'CERAMICA_PORCELANATO_INT_F2_SERV_30x60cm' or servParams[0][i] == 'CERAMICA_PORCELANATO_INT_F1_MEIA_PAREDE_SERV_30x60cm' or servParams[0][i] == 'CERAMICA_PORCELANATO_INT_F2_MEIA_PAREDE_SERV_30x60cm' or servParams[0][i] == 'CERAMICA_PORCELANA_INT_F1_SERV_5x10cm' or servParams[0][i] == 'CERAMICA_PORCELANA_INT_F2_SERV_5x10cm' or servParams[0][i] == 'CERAMICA_PORCELANA_INT_F1_MEIA_PAREDE_SERV_5x10cm' or servParams[0][i] == 'CERAMICA_PORCELANA_INT_F2_MEIA_PAREDE_SERV_5x10cm':
      walls.append(wallElements[i])
      paramsValue.append(servParams[0][i]+'_>=5m2')
      outRvtCod.append(rvtCod[i])

# Assign your output to the OUT variable.
OUT = walls, paramsValue, outRvtCod # paredes, valor para rvtCode, rvtCode
# ----------------------------------------
code_block_13 = CodeBlock { 0; }
# note: Elementos (paredes)
getItemAtIndex_2 = List.GetItemAtIndex(list=python_script_9, index=code_block_13)
code_block_14 = CodeBlock { 2; }
# note: RVT_COD
getItemAtIndex_3 = List.GetItemAtIndex(list=python_script_9, index=code_block_14)
code_block_15 = CodeBlock { 1; }
# note: Valor do RVT_COD
getItemAtIndex_4 = List.GetItemAtIndex(list=python_script_9, index=code_block_15)

# group (continued): Elementos com área< 5m², área >= 5m², área <=10m² e área > 10m² - Emboço Interno e Ceramicas Internas
setParameterByName_5 = Element.SetParameterByName(element=getItemAtIndex_2, parameterName=getItemAtIndex_3, value=getItemAtIndex_4)

# group: Elementos esquadria - janelas e portas
categories_2 = Categories("OST_Doors")
all_elements_of_category_2 = ElementsOfCategory(Category=categories_2)
elementType_2 = Element.ElementType(element=all_elements_of_category_2)
categories_3 = Categories("OST_Windows")
all_elements_of_category_3 = ElementsOfCategory(Category=categories_3)
elementType_3 = Element.ElementType(element=all_elements_of_category_3)
join_2 = List.Join(list0=all_elements_of_category_2, list1=all_elements_of_category_3)

join_3 = List.Join(list0=elementType_2, list1=elementType_3)
list_create_12 = List.Create(item0=join_3, item1=join_2)

# group: Esquadrias
python_script_10 = Python(IN[0]=list_create_12)
# ---------- python_script_10.python (14 lines) ----------
# Load the Python Standard and DesignScript Libraries
import sys
import clr
clr.AddReference('ProtoGeometry')
from Autodesk.DesignScript.Geometry import *

# The inputs to this node will be stored as a list in the IN variables.
dataEnteringNode = IN[0]

# Place your code below this line
elementType = dataEnteringNode[0]
elementCategory = dataEnteringNode[1]
# Assign your output to the OUT variable.
OUT = elementType, elementCategory
# ----------------------------------------
code_block_16 = CodeBlock { 1; }
# note: Element Category
getItemAtIndex_5 = List.GetItemAtIndex(list=python_script_10, index=code_block_16)
code_block_17 = CodeBlock { "AREA_ESQUADRIA"; }
code_block_18 = CodeBlock { 0; }
# note: Element Type
getItemAtIndex_6 = List.GetItemAtIndex(list=python_script_10, index=code_block_18)
code_block_19 = CodeBlock { "Height"; }
parameterByName = Parameter.ParameterByName(element=getItemAtIndex_6, name=code_block_19)
value = Parameter.Value(parameter=parameterByName)
code_block_20 = CodeBlock { "Width"; }
parameterByName_2 = Parameter.ParameterByName(element=getItemAtIndex_6, name=code_block_20)
value_2 = Parameter.Value(parameter=parameterByName_2)
python_script_11 = Python(IN[0]=value, IN[1]=value_2)
# ---------- python_script_11.python (18 lines) ----------
# Load the Python Standard and DesignScript Libraries
import sys
import clr
clr.AddReference('ProtoGeometry')
from Autodesk.DesignScript.Geometry import *

# The inputs to this node will be stored as a list in the IN variables.
height = IN[0]
width = IN[1]

area = []
result = 0
# Place your code below this line
for i in range(len(height)):
	result = round(height[i] * width[i], 2)
	area.append(str(result))
# Assign your output to the OUT variable.
OUT = area
# ----------------------------------------
setParameterByName_6 = Element.SetParameterByName(element=getItemAtIndex_5, parameterName=code_block_17, value=python_script_11)
code_block_21 = CodeBlock { "ESQUADRIA_RVT_COD"; }
code_block_22 = CodeBlock { "DESCRIPTION"; }
parameterByName_3 = Parameter.ParameterByName(element=getItemAtIndex_6, name=code_block_22)
value_3 = Parameter.Value(parameter=parameterByName_3)
setParameterByName_7 = Element.SetParameterByName(element=getItemAtIndex_5, parameterName=code_block_21, value=value_3)
