# Dynamo graph script3_inserir_codigo_gerar_planilha.dyn "script3_get_composoções_export_csv_FIX" (Dynamo 2.1.0.7500)

folha_da_planilha_contendo = StringInput("RevitXComposição")  # "Folha da planilha contendo códigos Revit e Composições"; graph input

# group: Importar do Excel
planilha_com_códigos_revit_e_de = Filename("..\..\Planilha_Treino_mod_nome_parametros.xlsx")  # "Planilha com códigos revit e de composições"; graph input
file_from_path = FileObject(path=planilha_com_códigos_revit_e_de)
boolean = BoolSelector(true)
boolean_2 = BoolSelector(true)
importExcel = Data.ImportExcel(file=file_from_path, sheetName=folha_da_planilha_contendo, readAsStrings=boolean, showExcel=boolean_2)

# note: Primeira linha da planilha
firstItem = List.FirstItem(list=importExcel)
planilha_do_excel_que_receberá_o = Filename("..\..\..\Planilha_Orçamentaria.xlsx")  # "Planilha do Excel que receberá o orçamento"; graph input
code_block = CodeBlock { "Orçamento"; }
code_block_2 = CodeBlock { 0; }

# group: Elementos por categoria
categories = Categories("OST_Walls")
all_elements_of_category = ElementsOfCategory(Category=categories)
categories_2 = Categories("OST_Windows")
all_elements_of_category_2 = ElementsOfCategory(Category=categories_2)
categories_3 = Categories("OST_Doors")
all_elements_of_category_3 = ElementsOfCategory(Category=categories_3)
join = List.Join(list0=all_elements_of_category, list1=all_elements_of_category_2, list2=all_elements_of_category_3)

# note: Modificado
code_block_3 = CodeBlock()
# ---------- code_block_3.designscript (17 lines) ----------
["PAREDE_RVT_COD",
"DIVISORIA_RVT_COD", "CHAPISCO_INT_F1_RVT_COD",
"CHAPISCO_INT_F2_RVT_COD",
"CHAPISCO_EXT_RVT_COD", "EMBOCO_INT_F1_RVT_COD",
"EMBOCO_INT_F2_RVT_COD",
"EMBOCO_EXT_RVT_COD", "CERAMICA_INT_F1_RVT_COD",
"CERAMICA_INT_F2_RVT_COD",
"CERAMICA_EXT_RVT_COD", "MASSA_UNICA_INT_F1_RVT_COD",
"MASSA_UNICA_INT_F2_RVT_COD", "MASSA_UNICA_EXT_RVT_COD",
"SELADOR_INT_F1_RVT_COD", "SELADOR_INT_F2_RVT_COD", "SELADOR_EXT_RVT_COD",
"MASSA_CORRIDA_INT_F1_RVT_COD", "MASSA_CORRIDA_INT_F2_RVT_COD",
"MASSA_CORRIDA_EXT_RVT_COD",
"PINTURA_INT_F1_RVT_COD", "PINTURA_INT_F2_RVT_COD", "PINTURA_EXT_RVT_COD",
"TEXTURA_INT_F1_RVT_COD", "TEXTURA_INT_F2_RVT_COD", "TEXTURA_EXT_RVT_COD",
"ENCUNHAMENTO_RVT_COD", "ISOLAMENTO_DRYWALL_RVT_COD",
"DEMOLICAO_CERAMICA_RVT_COD", "APICOAMENTO_RVT_COD",
"ESQUADRIA_RVT_COD"];
# ----------------------------------------
# note: Valor do RVT_COD
getParameterValueByName = Element.GetParameterValueByName(element=join, parameterName=code_block_3, lacing=CrossProduct)
restOfItems = List.RestOfItems(list=importExcel)
code_block_4 = CodeBlock { 0; }
getItemAtIndex = List.GetItemAtIndex(list=restOfItems@L2, index=code_block_4)
code_block_5 = CodeBlock { 1; }
# note: Valor do RVT_COMP
getItemAtIndex_2 = List.GetItemAtIndex(list=restOfItems@L2, index=code_block_5)

# group: Por aqui novas esquadrias
# note: Modificado
python_script = Python(IN[0]=join, IN[1]=getParameterValueByName, IN[2]=getItemAtIndex, IN[3]=getItemAtIndex_2)
# ---------- python_script.python (118 lines) ----------
# Load the Python Standard and DesignScript Libraries
import sys
import clr
clr.AddReference('ProtoGeometry')
from Autodesk.DesignScript.Geometry import *

# The inputs to this node will be stored as a list in the IN variables.
listOfElementsCategory = IN[0]
rvtCodeValue = IN[1]
listOfAllRvtCodeValues = IN[2]
listOfCompCode = IN[3]

elements = []
codeCompositionParam = []
codeCompositionValue = []

# Place your code below this line
for i in range(len(rvtCodeValue)):
  for k in range(len(rvtCodeValue[i])):
    for j in range(len(listOfAllRvtCodeValues)):
      if rvtCodeValue[i][k] == listOfAllRvtCodeValues[j]:
        elements.append(listOfElementsCategory[i])
        if rvtCodeValue[i][k] == 'ALVENARIA_BLC_CERAMICO_9X19X19cm_VÃO_>=6m2' or rvtCodeValue[i][k] == 'ALVENARIA_BLC_CERAMICO_9X19X19cm_VÃO_<6m2' or rvtCodeValue[i][k] == 'ALVENARIA_BLC_CERAMICO_9X19X19cm_SEM_VÃO_>=6m2' or rvtCodeValue[i][k] == 'ALVENARIA_BLC_CERAMICO_9X19X19cm_SEM_VÃO_<6m2' or rvtCodeValue[i][k] == 'ALVENARIA_BLC_CONCETO_9X19X39cm_VÃO_>=6m2' or rvtCodeValue[i][k] == 'ALVENARIA_BLC_CONCETO_9X19X39cm_VÃO_<6m2' or rvtCodeValue[i][k] == 'ALVENARIA_BLC_CONCETO_9X19X39cm_SEM_VÃO_>=6m2' or rvtCodeValue[i][k] == 'ALVENARIA_BLC_CONCETO_9X19X39cm_SEM_VÃO_<6m2' or rvtCodeValue[i][k] == 'ALVENARIA_BLC_CONCETO_14X19X39cm_VÃO_>=6m2' or rvtCodeValue[i][k] == 'ALVENARIA_BLC_CONCETO_14X19X39cm_VÃO_<6m2' or rvtCodeValue[i][k] == 'ALVENARIA_BLC_CONCETO_14X19X39cm_SEM_VÃO_>=6m2' or rvtCodeValue[i][k] == 'ALVENARIA_BLC_CONCETO_14X19X39cm_SEM_VÃO_<6m2' or rvtCodeValue[i][k] == 'PAREDE_BLC_GESSO_10cm' or rvtCodeValue[i][k] == 'DRYWALL_SIMPLES_VÃO' or rvtCodeValue[i][k] == 'DRYWALL_SIMPLES_SEM_VÃO' or rvtCodeValue[i][k] == 'DRYWALL_DUPLAS_VÃO' or rvtCodeValue[i][k] == 'DRYWALL_DUPLAS_SEM_VÃO':
          codeCompositionParam.append('PAREDE_COMP_COD')
          codeCompositionValue.append(listOfCompCode[j])
        elif rvtCodeValue[i][k] == 'CHAPISCO_INT_F1_SERV':
          codeCompositionParam.append('CHAPISCO_INT_F1_COMP_COD')
          codeCompositionValue.append(listOfCompCode[j])
        elif rvtCodeValue[i][k] == 'CHAPISCO_INT_F2_SERV':
          codeCompositionParam.append('CHAPISCO_INT_F2_COMP_COD')
          codeCompositionValue.append(listOfCompCode[j])
        elif rvtCodeValue[i][k] == 'CHAPISCO_EXT_SERV_VÃO' or rvtCodeValue[i][k] == 'CHAPISCO_EXT_SERV_SEM_VÃO':
          codeCompositionParam.append('CHAPISCO_EXT_COMP_COD')
          codeCompositionValue.append(listOfCompCode[j])
        elif rvtCodeValue[i][k] == 'EMBOCO_EXT_SERV_35mm_SEM_VÃO' or rvtCodeValue[i][k] == 'EMBOCO_EXT_SERV_35mm_VÃO' or rvtCodeValue[i][k] == 'EMBOCO_EXT_SERV_25mm_VÃO' or rvtCodeValue[i][k] == 'EMBOCO_EXT_SERV_25mm_SEM_VÃO' or rvtCodeValue[i][k] == 'EMBOCO_EXT_SERV_45mm_VÃO' or rvtCodeValue[i][k] == 'EMBOCO_EXT_SERV_45mm_SEM_VÃO' or rvtCodeValue[i][k] == 'EMBOCO_EXT_SERV_50mm_VÃO' or rvtCodeValue[i][k] == 'EMBOCO_EXT_SERV_50mm_SEM_VÃO':
          codeCompositionParam.append('EMBOCO_EXT_COMP_COD')
          codeCompositionValue.append(listOfCompCode[j])  
        elif rvtCodeValue[i][k] == 'DIVISORIA_GRANITO' or rvtCodeValue[i][k] == 'DIVISORIA_PVC_PAINEL_VIDRO_PAINEL' or rvtCodeValue[i][k] == 'DIVISORIA_PVC_PAINEL_VIDRO' or rvtCodeValue[i][k] == 'DIVISORIA_PVC_PAINEL' or rvtCodeValue[i][k] == 'DIVISORIA_PISO_TETO_VIDRO' or rvtCodeValue[i][k] == 'DIVISORIA_PISO_TETO_PAINEL_VIDRO' or rvtCodeValue[i][k] == 'DIVISORIA_PISO_TETO_PAINEL' or rvtCodeValue[i][k] == 'DIVISORIA_EUCATEX_PAINEL_VIDRO_PAINEL' or rvtCodeValue[i][k] == 'DIVISORIA_EUCATEX_PAINEL_VIDRO' or rvtCodeValue[i][k] == 'DIVISORIA_EUCATEX_PAINEL':
          codeCompositionParam.append('DIVISORIA_COMP_COD')
          codeCompositionValue.append(listOfCompCode[j])
        elif rvtCodeValue[i][k] == 'EMBOCO_INT_F1_SERV_10mm_<5m2' or rvtCodeValue[i][k] == 'EMBOCO_INT_F1_SERV_20mm_<5m2' or rvtCodeValue[i][k] == 'EMBOCO_INT_F1_SERV_10mm_>=5m2_E_<=10m2' or rvtCodeValue[i][k] == 'EMBOCO_INT_F1_SERV_20mm_>=5m2_E_<=10m2' or rvtCodeValue[i][k] == 'EMBOCO_INT_F1_SERV_10mm_>10m2' or rvtCodeValue[i][k] == 'EMBOCO_INT_F1_SERV_20mm_>10m2':
          codeCompositionParam.append('EMBOCO_INT_F1_COMP_COD')
          codeCompositionValue.append(listOfCompCode[j])
        elif rvtCodeValue[i][k] == 'EMBOCO_INT_F2_SERV_10mm_<5m2' or rvtCodeValue[i][k] == 'EMBOCO_INT_F2_SERV_20mm_<5m2' or rvtCodeValue[i][k] == 'EMBOCO_INT_F2_SERV_10mm_>=5m2_E_<=10m2' or rvtCodeValue[i][k] == 'EMBOCO_INT_F2_SERV_20mm_>=5m2_E_<=10m2' or rvtCodeValue[i][k] == 'EMBOCO_INT_F2_SERV_10mm_>10m2' or rvtCodeValue[i][k] == 'EMBOCO_INT_F2_SERV_20mm_>10m2':
          codeCompositionParam.append('EMBOCO_INT_F2_COMP_COD')
          codeCompositionValue.append(listOfCompCode[j])
        elif rvtCodeValue[i][k] == 'CERAMICA_INT_F1_MEIA_PAREDE_SERV_30x60cm_>=5m2' or rvtCodeValue[i][k] == 'CERAMICA_INT_F1_MEIA_PAREDE_SERV_30x60cm_<5m2' or rvtCodeValue[i][k] == 'CERAMICA_INT_F1_SERV_30x60cm_>=5m2' or rvtCodeValue[i][k] == 'CERAMICA_INT_F1_SERV_30x60cm_<5m2' or rvtCodeValue[i][k] == 'CERAMICA_INT_F1_MEIA_PAREDE_SERV_33x45cm_>=5m2' or rvtCodeValue[i][k] == 'CERAMICA_INT_F1_MEIA_PAREDE_SERV_33x45cm_<5m2' or rvtCodeValue[i][k] == 'CERAMICA_INT_F1_SERV_33x45cm_>=5m2' or rvtCodeValue[i][k] == 'CERAMICA_INT_F1_SERV_33x45cm_<5m2' or rvtCodeValue[i][k] == 'CERAMICA_PORCELANATO_INT_F1_SERV_30x60cm_<5m2' or rvtCodeValue[i][k] == 'CERAMICA_PORCELANA_INT_F1_MEIA_PAREDE_SERV_5x10cm_>=5m2' or rvtCodeValue[i][k] == 'CERAMICA_PORCELANATO_INT_F1_SERV_30x60cm_>=5m2' or rvtCodeValue[i][k] == 'CERAMICA_PORCELANATO_INT_F1_MEIA_PAREDE_SERV_30x60cm_<5m2' or rvtCodeValue[i][k] == 'CERAMICA_PORCELANATO_INT_F1_MEIA_PAREDE_SERV_30x60cm_>=5m2' or rvtCodeValue[i][k] == 'CERAMICA_PORCELANA_INT_F1_SERV_5x10cm_<5m2' or rvtCodeValue[i][k] == 'CERAMICA_PORCELANA_INT_F1_SERV_5x10cm_>=5m2' or rvtCodeValue[i][k] == 'CERAMICA_PORCELANA_INT_F1_MEIA_PAREDE_SERV_5x10cm_<5m2':
          codeCompositionParam.append('CERAMICA_INT_F1_COMP_COD')
          codeCompositionValue.append(listOfCompCode[j])
        elif rvtCodeValue[i][k] == 'CERAMICA_INT_F2_MEIA_PAREDE_SERV_30x60cm_>=5m2' or rvtCodeValue[i][k] == 'CERAMICA_INT_F2_MEIA_PAREDE_SERV_30x60cm_<5m2' or rvtCodeValue[i][k] == 'CERAMICA_INT_F2_SERV_30x60cm_>=5m2' or rvtCodeValue[i][k] == 'CERAMICA_INT_F2_SERV_30x60cm_<5m2' or rvtCodeValue[i][k] == 'CERAMICA_INT_F2_MEIA_PAREDE_SERV_33x45cm_>=5m2' or rvtCodeValue[i][k] == 'CERAMICA_INT_F2_MEIA_PAREDE_SERV_33x45cm_<5m2' or rvtCodeValue[i][k] == 'CERAMICA_INT_F2_SERV_33x45cm_>=5m2' or rvtCodeValue[i][k] == 'CERAMICA_INT_F2_SERV_33x45cm_<5m2' or rvtCodeValue[i][k] == 'CERAMICA_PORCELANATO_INT_F2_SERV_30x60cm_<5m2' or rvtCodeValue[i][k] == 'CERAMICA_PORCELANA_INT_F2_MEIA_PAREDE_SERV_5x10cm_>=5m2' or rvtCodeValue[i][k] == 'CERAMICA_PORCELANATO_INT_F2_SERV_30x60cm_>=5m2' or rvtCodeValue[i][k] == 'CERAMICA_PORCELANATO_INT_F2_MEIA_PAREDE_SERV_30x60cm_<5m2' or rvtCodeValue[i][k] == 'CERAMICA_PORCELANATO_INT_F2_MEIA_PAREDE_SERV_30x60cm_>=5m2' or rvtCodeValue[i][k] == 'CERAMICA_PORCELANA_INT_F2_SERV_5x10cm_<5m2' or rvtCodeValue[i][k] == 'CERAMICA_PORCELANA_INT_F2_SERV_5x10cm_>=5m2' or rvtCodeValue[i][k] == 'CERAMICA_PORCELANA_INT_F2_MEIA_PAREDE_SERV_5x10cm_<5m2':
          codeCompositionParam.append('CERAMICA_INT_F2_COMP_COD')
          codeCompositionValue.append(listOfCompCode[j])
        elif rvtCodeValue[i][k] == 'MASSA_UNICA_INT_F1_SERV_10mm' or rvtCodeValue[i][k] == 'MASSA_UNICA_INT_F1_SERV_20mm':
          codeCompositionParam.append('CERAMICA_INT_F1_COMP_COD')
          codeCompositionValue.append(listOfCompCode[j])
        elif rvtCodeValue[i][k] == 'MASSA_UNICA_INT_F2_SERV_10mm' or rvtCodeValue[i][k] == 'MASSA_UNICA_INT_F2_SERV_20mm':
          codeCompositionParam.append('CERAMICA_INT_F2_COMP_COD')
          codeCompositionValue.append(listOfCompCode[j])
        elif rvtCodeValue[i][k] == 'MASSA_UNICA_EXT_SERV_50mm_SEM_VÃO' or rvtCodeValue[i][k] == 'MASSA_UNICA_EXT_SERV_45mm_SEM_VÃO' or rvtCodeValue[i][k] == 'MASSA_UNICA_EXT_SERV_35mm_SEM_VÃO' or rvtCodeValue[i][k] == 'MASSA_UNICA_EXT_SERV_25mm_SEM_VÃO' or rvtCodeValue[i][k] == 'MASSA_UNICA_EXT_SERV_50mm_VÃO' or rvtCodeValue[i][k] == 'MASSA_UNICA_EXT_SERV_45mm_VÃO' or rvtCodeValue[i][k] == 'MASSA_UNICA_EXT_SERV_35mm_VÃO' or rvtCodeValue[i][k] == 'MASSA_UNICA_EXT_SERV_25mm_VÃO':
          codeCompositionParam.append('MASSA_UNICA_EXT_COMP_COD')
          codeCompositionValue.append(listOfCompCode[j])
        elif rvtCodeValue[i][k] == 'SELADOR_PVA_INT_F1_SERV' or rvtCodeValue[i][k] == 'SELADOR_ACRILICO_INT_F1_SERV':
          codeCompositionParam.append('SELADOR_INT_F1_COMP_COD')
          codeCompositionValue.append(listOfCompCode[j])
        elif rvtCodeValue[i][k] == 'SELADOR_PVA_INT_F2_SERV' or rvtCodeValue[i][k] == 'SELADOR_ACRILICO_INT_F2_SERV':
          codeCompositionParam.append('SELADOR_INT_F2_COMP_COD')
          codeCompositionValue.append(listOfCompCode[j])
        elif rvtCodeValue[i][k] == 'CERAMICA_PORCELANA_EXT_SERV_5x10cm_SEM_VÃO' or rvtCodeValue[i][k] == 'CERAMICA_PORCELANA_EXT_SERV_5x10cm_VÃO' or rvtCodeValue[i][k] == 'CERAMICA_PORCELANA_EXT_SERV_5x5cm_SEM_VÃO' or rvtCodeValue[i][k] == 'CERAMICA_PORCELANA_EXT_SERV_5x5cm_VÃO':
          codeCompositionParam.append('CERAMICA_EXT_COMP_COD')
          codeCompositionValue.append(listOfCompCode[j])
        elif rvtCodeValue[i][k] == 'SELADOR_ACRILICO_EXT_MULTPAV_SERV_SEM_VÃO' or rvtCodeValue[i][k] == 'SELADOR_ACRILICO_EXT_MULTPAV_SERV_VÃO' or rvtCodeValue[i][k] == 'SELADOR_ACRILICO_EXT_TERREO_SERV':
          codeCompositionParam.append('SELADOR_EXT_COMP_COD')
          codeCompositionValue.append(listOfCompCode[j])
        elif rvtCodeValue[i][k] == 'MASSA_CORRIDA_LATEX_INT_F1_DUAS_DEMAOS_SERV' or rvtCodeValue[i][k] == 'MASSA_CORRIDA_LATEX_INT_F1_UMA_DEMAO_SERV':
          codeCompositionParam.append('MASSA_CORRIDA_INT_F1_COMP_COD')
          codeCompositionValue.append(listOfCompCode[j])
        elif rvtCodeValue[i][k] == 'MASSA_CORRIDA_LATEX_INT_F2_DUAS_DEMAOS_SERV' or rvtCodeValue[i][k] == 'MASSA_CORRIDA_LATEX_INT_F2_UMA_DEMAO_SERV':
          codeCompositionParam.append('MASSA_CORRIDA_INT_F2_COMP_COD')
          codeCompositionValue.append(listOfCompCode[j])
        elif rvtCodeValue[i][k] == 'MASSA_CORRIDA_ACRILICA_EXT_DUAS_DEMAOS_MULTPAV_SERV_VÃO' or rvtCodeValue[i][k] == 'MASSA_CORRIDA_ACRILICA_EXT_UMA_DEMAO_MULTPAV_SERV_SEM_VÃO' or rvtCodeValue[i][k] == 'MASSA_CORRIDA_ACRILICA_EXT_DUAS_DEMAOS_MULTPAV_SERV_VÃO' or rvtCodeValue[i][k] == 'MASSA_CORRIDA_ACRILICA_EXT_UMA_DEMAO_MULTPAV_SERV_VÃO' or rvtCodeValue[i][k] == 'MASSA_CORRIDA_ACRILICA_EXT_DUAS_DEMAOS_TERREO_SERV' or rvtCodeValue[i][k] == 'MASSA_CORRIDA_ACRILICA_EXT_UMA_DEMAO_TERREO_SERV':
          codeCompositionParam.append('MASSA_CORRIDA_EXT_COMP_COD')
          codeCompositionValue.append(listOfCompCode[j])
        elif rvtCodeValue[i][k] == 'PINTURA_PVA_INT_F1_SERV' or rvtCodeValue[i][k] == 'PINTURA_ACRILICA_INT_F1_SERV':
          codeCompositionParam.append('PINTURA_INT_F1_COMP_COD')
          codeCompositionValue.append(listOfCompCode[j])
        elif rvtCodeValue[i][k] == 'PINTURA_PVA_INT_F2_SERV' or rvtCodeValue[i][k] == 'PINTURA_ACRILICA_INT_F2_SERV':
          codeCompositionParam.append('PINTURA_INT_F2_COMP_COD')
          codeCompositionValue.append(listOfCompCode[j])
        elif rvtCodeValue[i][k] == 'PINTURA_ACRILICA_EXT_TERREO_SERV' or rvtCodeValue[i][k] == 'PINTURA_ACRILICA_EXT_MULTPAV_SERV_VÃO' or rvtCodeValue[i][k] == 'PINTURA_ACRILICA_EXT_MULTPAV_SERV_SEM_VÃO':
          codeCompositionParam.append('PINTURA_EXT_COMP_COD')
          codeCompositionValue.append(listOfCompCode[j])
        elif rvtCodeValue[i][k] == 'TEXTURA_ACRILICA_INT_F1_SERV':
          codeCompositionParam.append('TEXTURA_INT_F1_COMP_COD')
          codeCompositionValue.append(listOfCompCode[j])
        elif rvtCodeValue[i][k] == 'TEXTURA_ACRILICA_INT_F2_SERV':
          codeCompositionParam.append('TEXTURA_INT_F2_COMP_COD')
          codeCompositionValue.append(listOfCompCode[j])
        elif rvtCodeValue[i][k] == 'TEXTURA_ACRILICA_EXT_UMA_COR_TERREO_SERV' or rvtCodeValue[i][k] == 'TEXTURA_ACRILICA_EXT_DUAS_CORES_TERREO_SERV' or rvtCodeValue[i][k] == 'TEXTURA_ACRILICA_EXT_UMA_COR_MULTPAV_SERV_VÃO' or rvtCodeValue[i][k] == 'TEXTURA_ACRILICA_EXT_DUAS_CORES_MULTPAV_SERV_VÃO' or rvtCodeValue[i][k] == 'TEXTURA_ACRILICA_EXT_UMA_COR_MULTPAV_SERV_SEM_VÃO' or rvtCodeValue[i][k] == 'TEXTURA_ACRILICA_EXT_DUAS_CORES_MULTPAV_SERV_SEM_VÃO':
          codeCompositionParam.append('TEXTURA_EXT_COMP_COD')
          codeCompositionValue.append(listOfCompCode[j])
        elif rvtCodeValue[i][k] == 'ENCUNHAMENTO_SERV':
          codeCompositionParam.append('ENCUNHAMENTO_COMP_COD')
          codeCompositionValue.append(listOfCompCode[j])
        elif rvtCodeValue[i][k] == 'ISOLAMENTO_DRYWALL_SERV':
          codeCompositionParam.append('ISOLAMENTO_DRYWALL_COMP_COD')
          codeCompositionValue.append(listOfCompCode[j])
        elif rvtCodeValue[i][k] == 'DEMOLIÇÃO_CERÂMICA_SERV':
          codeCompositionParam.append('DEMOLICAO_CERAMICA_COMP_COD')
          codeCompositionValue.append(listOfCompCode[j])
        elif rvtCodeValue[i][k] == 'APICOAMENTO_SERV':
          codeCompositionParam.append('APICOAMENTO_COMP_COD')
          codeCompositionValue.append(listOfCompCode[j])
        elif rvtCodeValue[i][k] == 'JA_0.9x2.15m_A' or rvtCodeValue[i][k] == 'PM1_1x2.1m_A':
          codeCompositionParam.append('ESQUADRIA_COMP_COD')
          codeCompositionValue.append(listOfCompCode[j])

# Assign your output to the OUT variable.
OUT = elements, codeCompositionParam, codeCompositionValue #paredes, código_param + código_value
# ----------------------------------------

code_block_6 = CodeBlock { 0; }
# note: Lista de elementos
getItemAtIndex_3 = List.GetItemAtIndex(list=python_script, index=code_block_6)
code_block_7 = CodeBlock { 1; }
# note: Lista de COMP_COD
getItemAtIndex_4 = List.GetItemAtIndex(list=python_script, index=code_block_7)
code_block_8 = CodeBlock { 2; }
# note: Códigos das composições
getItemAtIndex_5 = List.GetItemAtIndex(list=python_script, index=code_block_8)
# note: Associa código da composição aos elementos
setParameterByName = Element.SetParameterByName(element=getItemAtIndex_3, parameterName=getItemAtIndex_4, value=getItemAtIndex_5)
passthrough = Custom[Passthrough](passThrough=getItemAtIndex_3, waitFor=setParameterByName)  # Forces a sequential order of execution. The node wired into the output of the Passthrough node will be executed *after* the node wired into the waitFor input (e.g. important for some Revit operations). The value of the passThrough input will be passed on to the node wired into the output port of the Passthrough node.
flatten = List.Flatten(list=getParameterValueByName)
string = StringInput("")
eq = flatten == string
filterByBoolMask = List.FilterByBoolMask(list=flatten, mask=eq)
folha_da_planilha_contendo_2 = StringInput("ComposiçãoXCusto")  # "Folha da planilha contendo Códigos de Composições e Custo Unit."; graph input

# group: Importar do Excel
planilha_com_códigos_de = Filename("..\..\Planilha_Treino_mod_nome_parametros.xlsx")  # "Planilha com códigos de composição e preço unitário"; graph input
file_from_path_2 = FileObject(path=planilha_com_códigos_de)
boolean_3 = BoolSelector(true)
boolean_4 = BoolSelector(true)
importExcel_2 = Data.ImportExcel(file=file_from_path_2, sheetName=folha_da_planilha_contendo_2, readAsStrings=boolean_3, showExcel=boolean_4)

restOfItems_2 = List.RestOfItems(list=importExcel_2)
code_block_9 = CodeBlock { 0; }
getItemAtIndex_6 = List.GetItemAtIndex(list=restOfItems_2@L2, index=code_block_9)
code_block_10 = CodeBlock { 1; }
# note: Custo Unitário
getItemAtIndex_7 = List.GetItemAtIndex(list=restOfItems_2@L2, index=code_block_10)
# note: Retira custo unitários referentes às compisoções
python_script_2 = Python(IN[0]=getItemAtIndex_5, IN[1]=getItemAtIndex_6, IN[2]=getItemAtIndex_7)
# ---------- python_script_2.python (21 lines) ----------
# Load the Python Standard and DesignScript Libraries
import sys
import clr
clr.AddReference('ProtoGeometry')
from Autodesk.DesignScript.Geometry import *

# The inputs to this node will be stored as a list in the IN variables.
elements_COMP_COD = IN[0]
all_COMP_CODS = IN[1]
costs = IN[2]

outCosts = []
# Place your code below this line

for i in range(len(elements_COMP_COD)):
  for j in range(len(all_COMP_CODS)):
    if elements_COMP_COD[i] == all_COMP_CODS[j]:
      outCosts.append(costs[j])

# Assign your output to the OUT variable.
OUT = outCosts
# ----------------------------------------
code_block_11 = CodeBlock { "Area"; }
getParameterValueByName_2 = Element.GetParameterValueByName(element=passthrough, parameterName=code_block_11)
code_block_12 = CodeBlock { "AREA_ESQUADRIA"; }
getParameterValueByName_3 = Element.GetParameterValueByName(element=passthrough, parameterName=code_block_12)
code_block_13 = CodeBlock { "Length"; }
getParameterValueByName_4 = Element.GetParameterValueByName(element=passthrough, parameterName=code_block_13)
# note: 0 - elementos; 1 - rvt_cod; 2 - comp_cod; 3 - custos; 4 - area; 5 - area esquad.; 6 - length
python_script_3 = Python(IN[0]=passthrough, IN[1]=filterByBoolMask.out, IN[2]=getItemAtIndex_5, IN[3]=python_script_2, IN[4]=getParameterValueByName_2, IN[5]=getParameterValueByName_3, IN[6]=getParameterValueByName_4)
# ---------- python_script_3.python (33 lines) ----------
# Load the Python Standard and DesignScript Libraries
import sys
import clr
clr.AddReference('ProtoGeometry')
from Autodesk.DesignScript.Geometry import *

# The inputs to this node will be stored as a list in the IN variables.
elements = IN[0]
rvt_cod = IN[1]
comp_cod = IN[2]
costs = IN[3]
area = IN[4]  ## parede e serviços associados com unidade m²
area_esquad = IN[5] ## esquadrias
length = IN[6] ## serviços associados a parede com unidade m

outData = []
header = ['Elemento Revit', 'Código Composição', 'Unidade', 'Quantidade', 'Custo Unitário', 'Total']
excelRowAndColumn = []
# Place your code below this line

for i in range(len(elements)):
  if rvt_cod[i] == 'ALVENARIA_BLC_CERAMICO_9X19X19cm_VÃO_>=6m2' or rvt_cod[i] == 'ALVENARIA_BLC_CERAMICO_9X19X19cm_VÃO_<6m2' or rvt_cod[i] == 'ALVENARIA_BLC_CERAMICO_9X19X19cm_SEM_VÃO_>=6m2' or rvt_cod[i] == 'ALVENARIA_BLC_CERAMICO_9X19X19cm_SEM_VÃO_<6m2' or rvt_cod[i] == 'ALVENARIA_BLC_CONCETO_9X19X39cm_VÃO_>=6m2' or rvt_cod[i] == 'ALVENARIA_BLC_CONCETO_9X19X39cm_VÃO_<6m2' or rvt_cod[i] == 'ALVENARIA_BLC_CONCETO_9X19X39cm_SEM_VÃO_>=6m2' or rvt_cod[i] == 'ALVENARIA_BLC_CONCETO_9X19X39cm_SEM_VÃO_<6m2' or rvt_cod[i] == 'ALVENARIA_BLC_CONCETO_14X19X39cm_VÃO_>=6m2' or rvt_cod[i] == 'ALVENARIA_BLC_CONCETO_14X19X39cm_VÃO_<6m2' or rvt_cod[i] == 'ALVENARIA_BLC_CONCETO_14X19X39cm_SEM_VÃO_>=6m2' or rvt_cod[i] == 'ALVENARIA_BLC_CONCETO_14X19X39cm_SEM_VÃO_<6m2' or rvt_cod[i] == 'PAREDE_BLC_GESSO_10cm' or rvt_cod[i] == 'DRYWALL_SIMPLES_VÃO' or rvt_cod[i] == 'DRYWALL_SIMPLES_SEM_VÃO' or rvt_cod[i] == 'DRYWALL_DUPLAS_VÃO' or rvt_cod[i] == 'DRYWALL_DUPLAS_SEM_VÃO' or rvt_cod[i] == 'CHAPISCO_INT_F1_SERV' or rvt_cod[i] == 'CHAPISCO_INT_F2_SERV' or rvt_cod[i] == 'CHAPISCO_EXT_SERV_VÃO' or rvt_cod[i] == 'CHAPISCO_EXT_SERV_SEM_VÃO' or rvt_cod[i] == 'EMBOCO_EXT_SERV_35mm_SEM_VÃO' or rvt_cod[i] == 'EMBOCO_EXT_SERV_35mm_VÃO' or rvt_cod[i] == 'EMBOCO_EXT_SERV_25mm_VÃO' or rvt_cod[i] == 'EMBOCO_EXT_SERV_25mm_SEM_VÃO' or rvt_cod[i] == 'EMBOCO_EXT_SERV_45mm_VÃO' or rvt_cod[i] == 'EMBOCO_EXT_SERV_45mm_SEM_VÃO' or rvt_cod[i] == 'EMBOCO_EXT_SERV_50mm_VÃO' or rvt_cod[i] == 'EMBOCO_EXT_SERV_50mm_SEM_VÃO' or rvt_cod[i] == 'DIVISORIA_GRANITO' or rvt_cod[i] == 'DIVISORIA_PVC_PAINEL_VIDRO_PAINEL' or rvt_cod[i] == 'DIVISORIA_PVC_PAINEL_VIDRO' or rvt_cod[i] == 'DIVISORIA_PVC_PAINEL' or rvt_cod[i] == 'DIVISORIA_PISO_TETO_VIDRO' or rvt_cod[i] == 'DIVISORIA_PISO_TETO_PAINEL_VIDRO' or rvt_cod[i] == 'DIVISORIA_PISO_TETO_PAINEL' or rvt_cod[i] == 'DIVISORIA_EUCATEX_PAINEL_VIDRO_PAINEL' or rvt_cod[i] == 'DIVISORIA_EUCATEX_PAINEL_VIDRO' or rvt_cod[i] == 'DIVISORIA_EUCATEX_PAINEL' or rvt_cod[i] == 'EMBOCO_INT_F1_SERV_10mm_<5m2' or rvt_cod[i] == 'EMBOCO_INT_F2_SERV_10mm_<5m2' or rvt_cod[i] == 'EMBOCO_INT_F1_SERV_20mm_<5m2' or rvt_cod[i] == 'EMBOCO_INT_F2_SERV_20mm_<5m2' or rvt_cod[i] == 'EMBOCO_INT_F1_SERV_10mm_>=5m2_E_<=10m2' or rvt_cod[i] == 'EMBOCO_INT_F2_SERV_10mm_>=5m2_E_<=10m2' or rvt_cod[i] == 'EMBOCO_INT_F1_SERV_20mm_>=5m2_E_<=10m2' or rvt_cod[i] == 'EMBOCO_INT_F2_SERV_20mm_>=5m2_E_<=10m2' or rvt_cod[i] == 'EMBOCO_INT_F1_SERV_10mm_>10m2' or rvt_cod[i] == 'EMBOCO_INT_F2_SERV_10mm_>10m2' or rvt_cod[i] == 'EMBOCO_INT_F1_SERV_20mm_>10m2' or rvt_cod[i] == 'EMBOCO_INT_F2_SERV_20mm_>10m2' or rvt_cod[i] == 'CERAMICA_INT_F1_MEIA_PAREDE_SERV_30x60cm_>=5m2' or rvt_cod[i] == 'CERAMICA_INT_F2_MEIA_PAREDE_SERV_30x60cm_>=5m2' or rvt_cod[i] == 'CERAMICA_INT_F1_MEIA_PAREDE_SERV_30x60cm_<5m2' or rvt_cod[i] == 'CERAMICA_INT_F2_MEIA_PAREDE_SERV_30x60cm_<5m2' or rvt_cod[i] == 'CERAMICA_INT_F1_SERV_30x60cm_>=5m2' or rvt_cod[i] == 'CERAMICA_INT_F2_SERV_30x60cm_>=5m2' or rvt_cod[i] == 'CERAMICA_INT_F1_SERV_30x60cm_<5m2' or rvt_cod[i] == 'CERAMICA_INT_F2_SERV_30x60cm_<5m2' or rvt_cod[i] == 'CERAMICA_INT_F1_MEIA_PAREDE_SERV_33x45cm_>=5m2' or rvt_cod[i] == 'CERAMICA_INT_F2_MEIA_PAREDE_SERV_33x45cm_>=5m2' or rvt_cod[i] == 'CERAMICA_INT_F1_MEIA_PAREDE_SERV_33x45cm_<5m2' or rvt_cod[i] == 'CERAMICA_INT_F2_MEIA_PAREDE_SERV_33x45cm_<5m2' or rvt_cod[i] == 'CERAMICA_INT_F1_SERV_33x45cm_>=5m2' or rvt_cod[i] == 'CERAMICA_INT_F2_SERV_33x45cm_>=5m2' or rvt_cod[i] == 'CERAMICA_INT_F1_SERV_33x45cm_<5m2' or rvt_cod[i] == 'CERAMICA_INT_F2_SERV_33x45cm_<5m2' or rvt_cod[i] == 'CERAMICA_PORCELANATO_INT_F1_SERV_30x60cm_<5m2' or rvt_cod[i] == 'CERAMICA_PORCELANATO_INT_F2_SERV_30x60cm_<5m2' or rvt_cod[i] == 'CERAMICA_PORCELANA_INT_F1_MEIA_PAREDE_SERV_5x10cm_>=5m2' or rvt_cod[i] == 'CERAMICA_PORCELANA_INT_F2_MEIA_PAREDE_SERV_5x10cm_>=5m2' or rvt_cod[i] == 'CERAMICA_PORCELANATO_INT_F1_SERV_30x60cm_>=5m2' or rvt_cod[i] == 'CERAMICA_PORCELANATO_INT_F2_SERV_30x60cm_>=5m2' or rvt_cod[i] == 'CERAMICA_PORCELANATO_INT_F1_MEIA_PAREDE_SERV_30x60cm_<5m2' or rvt_cod[i] == 'CERAMICA_PORCELANATO_INT_F2_MEIA_PAREDE_SERV_30x60cm_<5m2' or rvt_cod[i] == 'CERAMICA_PORCELANATO_INT_F1_MEIA_PAREDE_SERV_30x60cm_>=5m2' or rvt_cod[i] == 'CERAMICA_PORCELANATO_INT_F2_MEIA_PAREDE_SERV_30x60cm_>=5m2' or rvt_cod[i] == 'CERAMICA_PORCELANA_INT_F1_SERV_5x10cm_<5m2' or rvt_cod[i] == 'CERAMICA_PORCELANA_INT_F2_SERV_5x10cm_<5m2' or rvt_cod[i] == 'CERAMICA_PORCELANA_INT_F1_SERV_5x10cm_>=5m2' or rvt_cod[i] == 'CERAMICA_PORCELANA_INT_F2_SERV_5x10cm_>=5m2' or rvt_cod[i] == 'CERAMICA_PORCELANA_INT_F1_MEIA_PAREDE_SERV_5x10cm_<5m2' or rvt_cod[i] == 'CERAMICA_PORCELANA_INT_F2_MEIA_PAREDE_SERV_5x10cm_<5m2' or rvt_cod[i] == 'MASSA_UNICA_INT_F1_SERV_10mm' or rvt_cod[i] == 'MASSA_UNICA_INT_F1_SERV_20mm' or rvt_cod[i] == 'MASSA_UNICA_INT_F2_SERV_10mm' or rvt_cod[i] == 'MASSA_UNICA_INT_F2_SERV_20mm' or rvt_cod[i] == 'MASSA_UNICA_EXT_SERV_50mm_SEM_VÃO' or rvt_cod[i] == 'MASSA_UNICA_EXT_SERV_45mm_SEM_VÃO' or rvt_cod[i] == 'MASSA_UNICA_EXT_SERV_35mm_SEM_VÃO' or rvt_cod[i] == 'MASSA_UNICA_EXT_SERV_25mm_SEM_VÃO' or rvt_cod[i] == 'MASSA_UNICA_EXT_SERV_50mm_VÃO' or rvt_cod[i] == 'MASSA_UNICA_EXT_SERV_45mm_VÃO' or rvt_cod[i] == 'MASSA_UNICA_EXT_SERV_35mm_VÃO' or rvt_cod[i] == 'MASSA_UNICA_EXT_SERV_25mm_VÃO' or rvt_cod[i] == 'SELADOR_PVA_INT_F1_SERV' or rvt_cod[i] == 'SELADOR_ACRILICO_INT_F1_SERV' or rvt_cod[i] == 'SELADOR_PVA_INT_F2_SERV' or rvt_cod[i] == 'SELADOR_ACRILICO_INT_F2_SERV' or rvt_cod[i] == 'CERAMICA_PORCELANA_EXT_SERV_5x10cm_SEM_VÃO' or rvt_cod[i] == 'CERAMICA_PORCELANA_EXT_SERV_5x10cm_VÃO' or rvt_cod[i] == 'CERAMICA_PORCELANA_EXT_SERV_5x5cm_SEM_VÃO' or rvt_cod[i] == 'CERAMICA_PORCELANA_EXT_SERV_5x5cm_VÃO' or rvt_cod[i] == 'SELADOR_ACRILICO_EXT_MULTPAV_SERV_SEM_VÃO' or rvt_cod[i] == 'SELADOR_ACRILICO_EXT_MULTPAV_SERV_VÃO' or rvt_cod[i] == 'SELADOR_ACRILICO_EXT_TERREO_SERV' or rvt_cod[i] == 'MASSA_CORRIDA_LATEX_INT_F1_DUAS_DEMAOS_SERV' or rvt_cod[i] == 'MASSA_CORRIDA_LATEX_INT_F1_UMA_DEMAO_SERV' or rvt_cod[i] == 'MASSA_CORRIDA_LATEX_INT_F2_DUAS_DEMAOS_SERV' or rvt_cod[i] == 'MASSA_CORRIDA_LATEX_INT_F2_UMA_DEMAO_SERV' or rvt_cod[i] == 'MASSA_CORRIDA_ACRILICA_EXT_DUAS_DEMAOS_MULTPAV_SERV_VÃO' or rvt_cod[i] == 'MASSA_CORRIDA_ACRILICA_EXT_UMA_DEMAO_MULTPAV_SERV_SEM_VÃO' or rvt_cod[i] == 'MASSA_CORRIDA_ACRILICA_EXT_DUAS_DEMAOS_MULTPAV_SERV_VÃO' or rvt_cod[i] == 'MASSA_CORRIDA_ACRILICA_EXT_UMA_DEMAO_MULTPAV_SERV_VÃO' or rvt_cod[i] == 'MASSA_CORRIDA_ACRILICA_EXT_DUAS_DEMAOS_TERREO_SERV' or rvt_cod[i] == 'MASSA_CORRIDA_ACRILICA_EXT_UMA_DEMAO_TERREO_SERV' or rvt_cod[i] == 'PINTURA_PVA_INT_F1_SERV' or rvt_cod[i] == 'PINTURA_ACRILICA_INT_F1_SERV' or rvt_cod[i] == 'PINTURA_PVA_INT_F2_SERV' or rvt_cod[i] == 'PINTURA_ACRILICA_INT_F2_SERV' or rvt_cod[i] == 'PINTURA_ACRILICA_EXT_TERREO_SERV' or rvt_cod[i] == 'PINTURA_ACRILICA_EXT_MULTPAV_SERV_VÃO' or rvt_cod[i] == 'PINTURA_ACRILICA_EXT_MULTPAV_SERV_SEM_VÃO' or rvt_cod[i] == 'TEXTURA_ACRILICA_INT_F1_SERV' or rvt_cod[i] == 'TEXTURA_ACRILICA_INT_F2_SERV' or rvt_cod[i] == 'TEXTURA_ACRILICA_EXT_UMA_COR_TERREO_SERV' or rvt_cod[i] == 'TEXTURA_ACRILICA_EXT_DUAS_CORES_TERREO_SERV' or rvt_cod[i] == 'TEXTURA_ACRILICA_EXT_UMA_COR_MULTPAV_SERV_VÃO' or rvt_cod[i] == 'TEXTURA_ACRILICA_EXT_DUAS_CORES_MULTPAV_SERV_VÃO' or rvt_cod[i] == 'TEXTURA_ACRILICA_EXT_UMA_COR_MULTPAV_SERV_SEM_VÃO' or rvt_cod[i] == 'TEXTURA_ACRILICA_EXT_DUAS_CORES_MULTPAV_SERV_SEM_VÃO' or rvt_cod[i] == 'ISOLAMENTO_DRYWALL_SERV' or rvt_cod[i] == 'DEMOLIÇÃO_CERÂMICA_SERV' or rvt_cod[i] == 'APICOAMENTO_SERV':  
    excelRowAndColumn.append(i + 2)
    outData.append([rvt_cod[i], comp_cod[i], 'm²', round(area[i], 2), costs[i], '=D'+str(excelRowAndColumn[i])+'*E'+str(excelRowAndColumn[i])])
  elif rvt_cod[i] == 'ENCUNHAMENTO_SERV':
    excelRowAndColumn.append(i + 2)
    outData.append([rvt_cod[i], comp_cod[i], 'm', round(length[i], 2), costs[i], '=D'+str(excelRowAndColumn[i])+'*E'+str(excelRowAndColumn[i])])
  elif rvt_cod[i] == 'JA_0.9x2.15m_A' or rvt_cod[i] == 'PM1_1x2.1m_A':
    excelRowAndColumn.append(i + 2)
    outData.append([rvt_cod[i], comp_cod[i], 'm²', area_esquad[i], costs[i], '=D'+str(excelRowAndColumn[i])+'*E'+str(excelRowAndColumn[i])])

# Assign your output to the OUT variable.
OUT = header, outData ## título, 
# ----------------------------------------
code_block_14 = CodeBlock { 0; }
# note: Excel - primeira linha
getItemAtIndex_8 = List.GetItemAtIndex(list=python_script_3, index=code_block_14)
list_create = List.Create(item0=getItemAtIndex_8)
code_block_15 = CodeBlock { 1; }
# note: Excel - segunda linha em diante
getItemAtIndex_9 = List.GetItemAtIndex(list=python_script_3, index=code_block_15)
join_2 = List.Join(list0=list_create, list1=getItemAtIndex_9)
code_block_16 = CodeBlock { false; }
exportExcel = Data.ExportExcel(filePath=planilha_do_excel_que_receberá_o, sheetName=code_block, startRow=code_block_2, startCol=code_block_2, data=join_2, overWrite=code_block_16)
firstItem_2 = List.FirstItem(list=importExcel_2)
